# Grasshopper definition TestRenders.gh (Grasshopper 1.0.7)
# Copyright: 2021
# plug-ins: MantaRay, LadybugGrasshopper, Human, HDTTreeUtils

panel = Panel("10.75.5.181")

# ----
# Connect
panel_2 = Panel("C:\simulation")
connect_ssh = ConnectSSH(User="mss", Ip="127.0.0.1", Password="_prompt", _port=22, Connect=Toggle(True))  # -> Status, Run, Run_2
panel_3 = Panel(connect_ssh.Status)

panel_4 = Panel("""Mesh
Polysurface
Surface
Extrusion""")

# ----
# Overview of all running tasks in linux
panel_5 = Panel("ps -aux | grep '<AllRadProgs>'")
logviewer = LogViewer(Number=10)  # -> CurrentTasks, Logs
default = DefaultMSS(data=flatten(panel_5), default_value_flattened=flatten(logviewer.CurrentTasks))
executessh_wip = ExecuteSSHWIP(
    _SSHCommands_=default,
    Run=Toggle(True),
    addPrefix=True,
    description="ps -aux | grep '<AllRadProgs>'",
    fireLogs=False,
    lastRunTime=9.5656,
    suppressWarnings=False,
    results="""mss      27896  0.0  0.0   8620  3140 ?        Ss   10:50   0:00 bash -c export PATH=$PATH:/usr/local/radiance/bin;export RAYPATH=.:/usr/local/radiance/lib;export DISPLAY=$(ip route list default | awk '{print $3}'):0;export LIBGL_ALWAYS_INDIRECT=1;ps -aux | grep 'arch2rad\|bgraph\|cnt\|compamb\|cv\|dayfact\|dctimestep\|dgraph\|ev\|falsecolor\|fieldcomb\|findglare\|gcomp\|genblinds\|genbox\|genBSDF\|genclock\|genklemsamp\|genprism\|genrev\|gensky\|genskyvec\|gensurf\|genworm\|getbbox\|getinfo\|glare\|glarendx\|glrad\|histo\|icalc\|ies2rad\|igraph\|lampcolor\|libmeta.a\|lookamb\|macbethcal\|meta\|meta2bmp\|meta2tga\|metafile\|mgf2meta\|mgf2rad\|mkillum\|mksource\|neaten\|normpat\|normtiff\|obj2mesh\|obj2rad\|objline\|objview\|oconv\|pcomb\|pcompos\|pcond\|pdfblur\|pexpand\|pextrem\|pfilt\|pflip\|phisto\|pinterp\|pkgBSDF\|plotin\|pmblur\|pmdblur\|protate\|psign\|psmeta\|psort\|pvalue\|ra_bmp\|ra_gif\|ra_pict\|ra_ppm\|ra_ps\|ra_rgbe\|ra_t16\|ra_t8\|ra_tiff\|ra_xyze\|rad\|rad2mgf\|raddepend\|ran2tiff\|ranimate\|ranimove\|rcalc\|replmarks\|rhcopy\|rhinfo\|rholo\|rhoptimize\|rhpict\|rlam\|rpict\|rpiece\| rsensor \|rtcontrib\|rtrace\|rvu\|tabfunc\|tmesh2rad\|total\|trad\|ttyimage\|vwrays\|vwright\|x11meta\|xform\|xglaresrc\|ximage\|xshowtrace'
mss      27901  0.0  0.0   8684  3008 ?        S    10:50   0:00 grep arch2rad\|bgraph\|cnt\|compamb\|cv\|dayfact\|dctimestep\|dgraph\|ev\|falsecolor\|fieldcomb\|findglare\|gcomp\|genblinds\|genbox\|genBSDF\|genclock\|genklemsamp\|genprism\|genrev\|gensky\|genskyvec\|gensurf\|genworm\|getbbox\|getinfo\|glare\|glarendx\|glrad\|histo\|icalc\|ies2rad\|igraph\|lampcolor\|libmeta.a\|lookamb\|macbethcal\|meta\|meta2bmp\|meta2tga\|metafile\|mgf2meta\|mgf2rad\|mkillum\|mksource\|neaten\|normpat\|normtiff\|obj2mesh\|obj2rad\|objline\|objview\|oconv\|pcomb\|pcompos\|pcond\|pdfblur\|pexpand\|pextrem\|pfilt\|pflip\|phisto\|pinterp\|pkgBSDF\|plotin\|pmblur\|pmdblur\|protate\|psign\|psmeta\|psort\|pvalue\|ra_bmp\|ra_gif\|ra_pict\|ra_ppm\|ra_ps\|ra_rgbe\|ra_t16\|ra_t8\|ra_tiff\|ra_xyze\|rad\|rad2mgf\|raddepend\|ran2tiff\|ranimate\|ranimove\|rcalc\|replmarks\|rhcopy\|rhinfo\|rholo\|rhoptimize\|rhpict\|rlam\|rpict\|rpiece\| rsensor \|rtcontrib\|rtrace\|rvu\|tabfunc\|tmesh2rad\|total\|trad\|ttyimage\|vwrays\|vwright\|x11meta\|xform\|xglaresrc\|ximage\|xshowtrace""",
    commands="ps -aux | grep '<AllRadProgs>'")  # -> Stdout, Stderr_, Ran
python = GhPythonScript(x=executessh_wip.Stdout)  # -> a
# ---------- python: Python ----------
__author__ = "mm1013"
__version__ = "2022.08.30"

import rhinoscriptsyntax as rs

a = [l for l in x.split("\n") if "grep" not in l]
# ---------- end python ----------
panel_6 = Panel(python)
panel_7 = Panel(logviewer.CurrentTasks)

# ----
# Setup globals
panel_8 = Panel("""proj
projname
projfolder""")
panel_9 = Panel("""~/simulation/boston
boston
/simulation/boston""")
global_overrides = GlobalOverrides(Keys=panel_8, Values=panel_9)
panel_10 = Panel(global_overrides)

od_outdated = ColourSwatch(SwatchColor=RGBA(97, 97, 97, 150))
u_updated = ColourSwatch(SwatchColor=RGBA(208, 115, 230, 112))
o_outputs = ColourSwatch(SwatchColor=RGBA(160, 218, 242, 203))
toggle = BooleanToggle(True)
s_settings = ColourSwatch(SwatchColor=RGBA(224, 145, 81, 154))
g_general = ColourSwatch(SwatchColor=RGBA(245, 243, 237, 156))
cc_core2 = ColourSwatch(SwatchColor=RGBA(230, 216, 186, 208))
y_yellow = ColourSwatch(SwatchColor=RGBA(247, 244, 64, 188))
i_inputs = ColourSwatch(SwatchColor=RGBA(125, 217, 98, 150))
c_core = ColourSwatch(SwatchColor=RGBA(235, 227, 206, 203))
r_red = ColourSwatch(SwatchColor=RGBA(242, 63, 63, 203))

# ----
# Test connection
testconnection = TestConnection()  # -> Status, Errors
panel_11 = Panel(testconnection.Status)
panel_12 = Panel(testconnection.Errors)

# ----
# processes to kill
panel_13 = Panel("""dctimestep
rcontrib
rtrace
oconv
rvu
rmtxop""")
kill = LBFalseStartToggle(False)

# ----
# Kill processes running on linux
panel_14 = Panel("pkill -f <instance>")
overrides = ApplyOverrides(Input_=panel_14, Instance=graft(panel_13))  # -> flatten(Output), Pairs
join = TextJoin(Text=overrides.Output, Join=";")
executessh_wip_2 = ExecuteSSHWIP(
    _SSHCommands_=join,
    Run=kill,
    addPrefix=True,
    description="pkill -f dctimestep;pkill -f rcontrib;pkill -f rtrace;pkill -f oconv;pkill -f rvu;pkill -f rmtxop",
    fireLogs=False,
    lastRunTime=0,
    suppressWarnings=False)  # -> Stdout, Stderr_, Ran
# Check if ximage and other x-commands work.
# Must have Xlaunch running on windows with disabled access control
# Otherwise it will crash!
panel_15 = Panel(executessh_wip_2.Stderr_)

# ----
# importing from rhino layers
dpipeline = DynamicGeometryPipeline(
    LayerFilter="Daylight_Inputs::*",
    TypeFilter=panel_4,
    NameFilter="*",
    GroupByLayer=False,
    GroupByType=False,
    IncludeHidden=True,
    IncludeLocked=True,
    enableFullPath=True,
    listenToAttributes=True)
dam = DataDam(DataA=dpipeline, BufferDelay=10000000, BufferMode=0)
objatts = ObjectAttributes(ObjectOrAttributes=dam)  # -> Name, LayerName, LayerFullPath, Color, MaterialName, LinetypeName, GroupIndices, PlotWeight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
cset = CreateSet(List=objatts.LayerName)  # -> Set, Map
assign_paths = AssignPaths(InputData=flatten(dam), PathsToAssign=flatten(cset.Map))
python_2 = GhPythonScript(layer_name=graft(cset.Set))  # -> is_opaque, is_transparent, is_grid, is_HB_Room, is_HB_Window
# ---------- python_2: Python ----------
__author__ = "mm1013"
__version__ = "2022.01.16"

import rhinoscriptsyntax as rs

is_grid = layer_name == "Grids"

if layer_name.startswith("HB_"):
    is_opaque = is_transparent = is_grid = False
    
    is_HB_Window = layer_name.endswith("%")
    is_HB_Room = layer_name == "HB_Rooms"
    
    
else:
    if is_grid:
        is_opaque = False
        is_transparent = False
    else:
        is_transparent = layer_name.endswith("%")
        if is_transparent:
            transmittance = layer_name.split("_")[-1].replace("%","")
        is_opaque = not is_transparent
# ---------- end python_2 ----------
layer_name = Text(cset.Set)
geo = Geometry(assign_paths)

colorgroups = CSharpScript(
    Colors=[i_inputs, s_settings, g_general, c_core, o_outputs, r_red, y_yellow, u_updated, od_outdated, cc_core2],
    Enable=toggle,
    Rename=Toggle(False),
    RunOnce=Button(),
    Debug=Toggle(False))  # -> out; inputs Colors: list of Color, Enable: Boolean, Rename: Boolean, RunOnce: Boolean, Debug: Boolean
# ---------- colorgroups: C# usings ----------
using System.Linq;
using System.Text;
using System.Reflection;
# ---------- colorgroups: C# ----------
    msg.Clear();


    this.Component.Message = "id: " + id.ToString();

    _debug = Debug; //Set to true to have all events printed in rhino log
    _rename = Rename;

    if (Enable)
    {
      msg.AppendFormat("Set up events on ID {0}\n", id);
      SetupDict(); // Create a dictionary of the input swatches
      SetEventHandlers(); // This would do the job.


    }
    else
    {
      RemoveEventHandlers();
    }
    if (RunOnce)
    {
      foreach(Grasshopper.Kernel.Special.GH_Group grp in Grasshopper.Instances.ActiveCanvas.Document.Objects.OfType<Grasshopper.Kernel.Special.GH_Group>())
      {
        ColorGroup(grp, null); // You decide if it should run once on all existing groups

      }
    }

    Print(msg.ToString());


    // Component setup
    Component.Description = "Set up event handlers to color groups based on prefixes such as 'in_' and 'out_'.\n"
      + "Please insert only swatcheds directly into the Colors input\n\n"
      + "MIT License. Copyright Mathias Sønderskov Schaltz 2022";
    Component.Params.Input[0].Description = "Please insert only swatcheds directly into the Colors input.\nRemember to rename them";
    Component.Params.Input[1].Description = "Toggle to run...";
    Component.Params.Input[2].Description = "Set to true if you want to automatically rename the groups and remove prefix. Default is false.";
    Component.Params.Input[3].Description = "Set to true to run it once and color all existing groups.";
    Component.Params.Input[Component.Params.Input.Count - 1].Description = "Set debug to true to get all the events printed in the rhino log";
# ---------- colorgroups: C# additional code ----------
  public static Random rnd = new Random();
  public int id = rnd.Next(0, 1000);
  StringBuilder msg = new StringBuilder();
  Dictionary<string, System.Drawing.Color> colorDict = new Dictionary<string, System.Drawing.Color>();

  bool _debug = false;
  bool _rename = false;

  public bool IdExists(int id)
  {
    IList<IGH_DocumentObject> objs = Grasshopper.Instances.ActiveCanvas.Document.Objects;
    return objs
      .OfType<IGH_Component>()
      .Where(ob => ob.NickName == this.Component.NickName)
      .Where(ob => ob.GetType().ToString() == "ScriptComponents.Component_CSNET_Script")
      .Where(ob => ob.Message == "id: " + id.ToString()).Any();

  }


  public void SetupDict()
  {
    colorDict.Clear();
    // Get all inputs to "Colors"
    IList<IGH_Param> colorSources = this.Component.Params.Input[0].Sources;
    if (colorSources.Count == 0)
    {
      throw new Exception("You forgot to setup the colors. Please input swatch components and rename them");
    }
    foreach(IGH_Param source in colorSources)
    {
      //if (source.Type.ToString() == "Grasshopper.Kernel.Types.GH_Colour")
      if (source is Grasshopper.Kernel.Special.GH_ColourSwatch)
      {
        string nickName = source.NickName.Split('_')[0].Trim() + "_";
        if(!colorDict.ContainsKey(nickName))
        {
          Grasshopper.Kernel.Special.GH_ColourSwatch swatch = (Grasshopper.Kernel.Special.GH_ColourSwatch) source;
          colorDict.Add(nickName, swatch.SwatchColour);
        }
        else
        {
          throw new Exception("Multiple swatches using the same name detected. Please rename");
        }
      }
      else
      {
        throw new Exception("Whacko! Why did you input a non-swatch into the Colors? " + source.Type.ToString());
      }

    }

    msg.AppendFormat("Set up the dictionaries with {0} colors\n", colorDict.Count);
    foreach(var pairs in colorDict)
    {
      msg.AppendFormat("{0} -> {1}\n", ("\"" + pairs.Key + "\"").PadRight(5 + colorDict.Keys.Select(k => k.Length).Max()), pairs.Value);
    }
  }

  public void SetEventHandlers()
  {

    // Always remove events first to avoid duplicates
    GrasshopperDocument.ObjectsAdded -= OnObjectsAdded;
    GrasshopperDocument.ObjectsDeleted -= OnObjectsRemoved;
    GrasshopperDocument.ObjectsDeleted -= OnDeleteThisComponent;

    // Attach events
    GrasshopperDocument.ObjectsAdded += OnObjectsAdded;
    GrasshopperDocument.ObjectsDeleted += OnObjectsRemoved;
    GrasshopperDocument.ObjectsDeleted += OnDeleteThisComponent;


    foreach(Grasshopper.Kernel.Special.GH_Group grp in GrasshopperDocument.Objects.OfType<Grasshopper.Kernel.Special.GH_Group>())
    {
      grp.ObjectChanged -= ColorGroup;
      grp.ObjectChanged += ColorGroup;

      //ColorGroup(grp, null); // Make sure to run it once
    }
    msg.AppendFormat("Added the eventhandlers on {0} existing groups and on future created groups\n", GrasshopperDocument.Objects.OfType<Grasshopper.Kernel.Special.GH_Group>().Count());
  }

  public void OnObjectsAdded(object sender, GH_DocObjectEventArgs e)
  {
    bool any = false;
    foreach (Grasshopper.Kernel.Special.GH_Group grp in e.Objects.OfType<Grasshopper.Kernel.Special.GH_Group>())
    {
      grp.ObjectChanged -= ColorGroup;
      grp.ObjectChanged += ColorGroup;
      any = true;
    }

    DebugWrite(any ? "Group Objects Added: Attaching Events to ObjectChanged" : "Objects Added - but no groups");
  }

  //Same but reversed
  public void OnObjectsRemoved(object sender, GH_DocObjectEventArgs e)
  {
    bool any = false;
    foreach (Grasshopper.Kernel.Special.GH_Group grp in e.Objects.OfType<Grasshopper.Kernel.Special.GH_Group>())
    {
      grp.ObjectChanged -= ColorGroup;
      any = true;
    }

    DebugWrite(any ? "Group Objects Removed, removing event" : "Objects Removed - although not a group");

  }



  public void RemoveEventHandlers()
  {
    GrasshopperDocument.ObjectsAdded -= OnObjectsAdded;
    GrasshopperDocument.ObjectsDeleted -= OnObjectsRemoved;


    foreach(Grasshopper.Kernel.Special.GH_Group grp in GrasshopperDocument.Objects.OfType<Grasshopper.Kernel.Special.GH_Group>())
    {
      grp.ObjectChanged -= ColorGroup;

    }
    msg.AppendFormat("Removed event handlers on document and on {0} groups\n", GrasshopperDocument.Objects.OfType<Grasshopper.Kernel.Special.GH_Group>().Count());

  }

  public void ColorGroup(object sender, EventArgs e)
  {
    if (!IdExists(id))
    {
      DebugWrite("Component not relevant. Disabling old id + " + id.ToString());
      RemoveEventHandlers();
      return;
    }

    Grasshopper.Kernel.Special.GH_Group grp = sender as Grasshopper.Kernel.Special.GH_Group;
    if (grp == null) return; //not type GH_Group
    //if (!grp.NickName.EndsWith("_")) return;

    string[] nameParts = grp.NickName.Split('_');
    if (nameParts.Length <= 1)
      return;
    string prefix = grp.NickName.Split('_')[0].Trim() + '_';

    string prefixes = String.Join(", ", colorDict.Keys.Select(k => "\"" + k + "\""));

    msg.Append("prefix " + prefix + "\n");
    if (colorDict.ContainsKey(prefix))
    {
      //if (grp.NickName.EndsWith("_"))
      grp.Colour = colorDict[prefix];
      if (_rename)
      {
        grp.NickName = grp.NickName.Replace(prefix, "");
      }

      DebugWrite("Colored " + grp.NickName);

    }
    else
    {
      DebugWrite("Group changed but not relevant: prefix " + prefix + " is not among " + prefixes);
    }

  }
  public void DebugWrite(string msg)
  {
    if (_debug)
    {
      Rhino.RhinoApp.WriteLine(String.Format("[ColGrps {0}]: {1}", id, msg));
    }
  }

  public void OnDeleteThisComponent(object sender, GH_DocObjectEventArgs e)
  {

    if (e.Objects.OfType<Grasshopper.Kernel.GH_Component>().Where(o => o.NickName == this.Component.NickName).Any())
    {
      DebugWrite("Removed template component. Removing all the eventhandlers");
      RemoveEventHandlers();
    }

  }
# ---------- end colorgroups ----------

fixparams = CSharpScript(FixOnce=Button(), Enable=toggle, Debug=Toggle(False))  # -> out; inputs FixOnce: Boolean, Enable: Boolean, Debug: Boolean
# ---------- fixparams: C# usings ----------
using System.Text;
using System.Linq;
using Grasshopper.Kernel.Special;
# ---------- fixparams: C# ----------
    _debug = Debug;
    _enable = Enable;
    msg.Clear();
    this.Component.Message = "id: " + id.ToString();




    if (Enable)
    {
      SetEventHandlers();
    }
    else
    {
      RemoveEventHandlers();
    }


    if (FixOnce)
    {
      FixAll();
    }

    Print(msg.ToString());

    // Component setup
    Component.Description = "Set up event handlers to change params to show nickname and not icon"
      + "\n\n"
      + "MIT License. Copyright Mathias Sønderskov Schaltz 2022";
    Component.Params.Input[0].Description = "Run me once on the document";
    Component.Params.Input[1].Description = "Toggle to enable event listener";
    Component.Params.Input[Component.Params.Input.Count - 1].Description = "Set debug to true to get all the events printed in the rhino log";
# ---------- fixparams: C# additional code ----------
  public static Random rnd = new Random();
  public int id = rnd.Next(0, 1000);
  StringBuilder msg = new StringBuilder();
  bool _debug = false;
  bool _enable = false;

  public Dictionary<IGH_ActiveObject, HashSet<GH_Group>> groupsPerObject = new Dictionary<IGH_ActiveObject, HashSet<GH_Group>>();


  public void OnObjectsAdded(object sender, GH_DocObjectEventArgs e)
  {
    if (!IdExists(id))
    {
      DebugWrite("[FixParam] Component not relevant. Disabling old id " + id.ToString());
      RemoveEventHandlers();
      return;
    }


    if(_enable)
    {
      foreach(IGH_Param par in e.Objects.OfType<IGH_Param>())
      {
        FixInputs(par);
      }
    }


  }

  public void FixAll()
  {
    //DebugWrite("Fixing all?");
    foreach(IGH_Param par in GrasshopperDocument.Objects.OfType<IGH_Param>())
    {

      FixInputs(par);
    }
  }




  public void FixInputs(IGH_ActiveObject obj)
  {



    IGH_Param par = obj as IGH_Param;
    if (par != null)
    {

      par.IconDisplayMode = GH_IconDisplayMode.name;


    }

  }


  public void SetEventHandlers()
  {

    GrasshopperDocument.ObjectsAdded -= OnObjectsAdded;
    GrasshopperDocument.ObjectsAdded += OnObjectsAdded;
    GrasshopperDocument.ObjectsDeleted -= OnDeleteThisComponent;
    GrasshopperDocument.ObjectsDeleted += OnDeleteThisComponent;
    msg.AppendFormat("Added the eventhandlers to OnObjectsAdded\n", GrasshopperDocument.Objects.OfType<Grasshopper.Kernel.Special.GH_Group>().Count());
  }

  public void RemoveEventHandlers()
  {
    GrasshopperDocument.ObjectsAdded -= OnObjectsAdded;
    GrasshopperDocument.ObjectsDeleted -= OnDeleteThisComponent;

    msg.AppendFormat("Removed wire event handlers on document\n", GrasshopperDocument.Objects.OfType<Grasshopper.Kernel.Special.GH_Group>().Count());

  }

  public void OnDeleteThisComponent(object sender, GH_DocObjectEventArgs e)
  {

    if (e.Objects.OfType<Grasshopper.Kernel.GH_Component>().Where(o => o.NickName == this.Component.NickName).Any())
    {
      DebugWrite("Removed template component. Removing all the eventhandlers");
      RemoveEventHandlers();
    }

  }

  public bool IdExists(int id)
  {
    IList<IGH_DocumentObject> objs = Grasshopper.Instances.ActiveCanvas.Document.Objects;
    return objs
      .OfType<IGH_Component>()
      .Where(ob => ob.NickName == this.Component.NickName)
      .Where(ob => ob.GetType().ToString() == "ScriptComponents.Component_CSNET_Script")
      .Where(ob => ob.Message == "id: " + id.ToString()).Any();

  }

  public void DebugWrite(string msg)
  {
    if (_debug)
    {
      Rhino.RhinoApp.WriteLine(String.Format("[FixParams {0}]: {1}", id, msg));
    }
  }
# ---------- end fixparams ----------

fixwires = CSharpScript(FixOnce=Button(), Enable=toggle, Debug=Toggle(False))  # -> out; inputs FixOnce: Boolean, Enable: Boolean, Debug: Boolean
# ---------- fixwires: C# ----------
    _debug = Debug;
    _enable = Enable;
    msg.Clear();
    this.Component.Message = "id: " + id.ToString();


    SetDictionary();

    if (Enable)
    {
      SetEventHandlers();
    }
    else
    {
      RemoveEventHandlers();
    }


    if (FixOnce)
    {
      FixAll();
    }

    Print(msg.ToString());
    
    // Component setup
    Component.Description = "Set up event handlers to change all wire types across groups to faint"
      + "\n\n"
      + "MIT License. Copyright Mathias Sønderskov Schaltz 2022";
    Component.Params.Input[0].Description = "Run me once on the document";
    Component.Params.Input[1].Description = "Toggle to enable event listener";
    Component.Params.Input[Component.Params.Input.Count - 1].Description = "Set debug to true to get all the events printed in the rhino log";
# ---------- fixwires: C# additional code ----------
  public static Random rnd = new Random();
  public int id = rnd.Next(0, 1000);
  StringBuilder msg = new StringBuilder();
  bool _debug = false;
  bool _enable = false;

  public Dictionary<IGH_ActiveObject, HashSet<GH_Group>> groupsPerObject = new Dictionary<IGH_ActiveObject, HashSet<GH_Group>>();


  public void OnSolutionExpired(object sender, GH_DocUndoEventArgs e)
  {
    if(_enable)
      FixAll();
  }

  public void FixAll()
  {
    //DebugWrite("Fixing all?");
    foreach(IGH_ActiveObject key in groupsPerObject.Keys.Where(k => groupsPerObject[k].Count() > 0))
    {

      FixInputs(key);
    }
  }



  public bool HasGroup(IGH_ActiveObject obj)
  {
    return groupsPerObject[obj].Count > 0;
  }


  public void FixInputs(IGH_ActiveObject obj)
  {

    if (!IdExists(id))
    {
      DebugWrite("Component not relevant. Disabling old id " + id.ToString());
      RemoveEventHandlers();
      return;
    }

    //List<List<IGH_ActiveObject>> parents = new List<List<IGH_ActiveObject>>();
    IGH_Param par = obj as IGH_Param;
    if (par != null && par.Sources != null)
    {


      IEnumerable<IGH_ActiveObject> p = par.Sources.Select(s => s.Attributes.GetTopLevel.DocObject as IGH_ActiveObject);
      //parents.Add(p);
      if(HasGroup(obj) && p.All(o => !HasGroupsInCommon(o, obj)) && par.WireDisplay != GH_ParamWireDisplay.faint)
      {
        DebugWrite("Fixing " + par.Attributes.GetTopLevel.DocObject.NickName);
        par.WireDisplay = GH_ParamWireDisplay.faint;
      }

    }

    IGH_Component comp = obj as IGH_Component;
    if (comp != null)
    {
      foreach(IGH_Param inp in comp.Params.Input)
      {

        IEnumerable<IGH_ActiveObject> p = inp.Sources.Select(i => i.Attributes.GetTopLevel.DocObject as IGH_ActiveObject);

        if(HasGroup(obj) && p.All(o => !HasGroupsInCommon(o, obj)) && inp.WireDisplay != GH_ParamWireDisplay.faint)
        {
          DebugWrite("Fixing " + inp.Attributes.GetTopLevel.DocObject.NickName);
          inp.WireDisplay = GH_ParamWireDisplay.faint;
        }
      }

    }



  }





  public void SetDictionary()
  {
    IList<IGH_DocumentObject> objects = Grasshopper.Instances.ActiveCanvas.Document.Objects.ToList();
    //Print(String.Join(", ", objects.Select(o => o.NickName)));

    groupsPerObject = objects
      .Where(o => o.GetType() != typeof(GH_Group))
      .OfType<IGH_ActiveObject>()
      .ToDictionary(o => o, o => new HashSet<GH_Group>());

    foreach(GH_Group grp in objects.OfType<GH_Group>())
    {

      foreach(IGH_ActiveObject obj in grp.ObjectsRecursive().OfType<IGH_ActiveObject>())
      {
        groupsPerObject[obj].Add(grp);

      }
    }



  }

  public bool HasGroupsInCommon(IGH_ActiveObject obj1, IGH_ActiveObject obj2)
  {
    HashSet<GH_Group> set1 = groupsPerObject[obj1];
    HashSet<GH_Group> set2 = groupsPerObject[obj2];

    set1.IntersectWith(set2);

    return set1.Any();
  }

  public void SetEventHandlers()
  {

    GrasshopperDocument.UndoStateChanged -= OnSolutionExpired;
    GrasshopperDocument.UndoStateChanged += OnSolutionExpired;
    GrasshopperDocument.ObjectsDeleted -= OnDeleteThisComponent;
    GrasshopperDocument.ObjectsDeleted += OnDeleteThisComponent;
    msg.AppendFormat("Added the eventhandlers to UndoStateChanged\n", GrasshopperDocument.Objects.OfType<Grasshopper.Kernel.Special.GH_Group>().Count());
  }

  public void RemoveEventHandlers()
  {
    GrasshopperDocument.UndoStateChanged -= OnSolutionExpired;
    GrasshopperDocument.ObjectsDeleted -= OnDeleteThisComponent;

    msg.AppendFormat("Removed wire event handlers on document\n", GrasshopperDocument.Objects.OfType<Grasshopper.Kernel.Special.GH_Group>().Count());

  }

  public void OnDeleteThisComponent(object sender, GH_DocObjectEventArgs e)
  {

    if (e.Objects.OfType<Grasshopper.Kernel.GH_Component>().Where(o => o.NickName == this.Component.NickName).Any())
    {
      DebugWrite("Removed template component. Removing all the eventhandlers");
      RemoveEventHandlers();
    }

  }

  public bool IdExists(int id)
  {
    IList<IGH_DocumentObject> objs = Grasshopper.Instances.ActiveCanvas.Document.Objects;
    return objs
      .OfType<IGH_Component>()
      .Where(ob => ob.NickName == this.Component.NickName)
      .Where(ob => ob.GetType().ToString() == "ScriptComponents.Component_CSNET_Script")
      .Where(ob => ob.Message == "id: " + id.ToString()).Any();

  }

  public void DebugWrite(string msg)
  {
    if (_debug)
    {
      Rhino.RhinoApp.WriteLine(String.Format("[FixWire {0}]: {1}", id, msg));
    }
  }
# ---------- end fixwires ----------

nickname = GH_TestComponentColor(Color=ColourSwatch(SwatchColor=RGB(188, 118, 194)), SelColor=ColourSwatch(SwatchColor=RGB(191, 128, 128)))

# ----
# Template methods
# By Mathias Sønderskov Schaltz 2022
# Check for updates here https://github.com/Sonderwoods/GrasshopperScribbles
panel_16 = Panel(fixwires)
panel_17 = Panel(fixparams)
panel_18 = Panel(colorgroups)

# ----
# Log of latest(10) SSH Commands
logviewer_2 = LogViewer(Number=10)  # -> CurrentTasks, Logs

# ----
# Glass geometries
cull = CullPattern(List=geo, CullPattern=python_2.is_transparent)
cull_2 = CullPattern(List=graft(layer_name), CullPattern=graft(python_2.is_transparent))  # -> simplify(List)
python_3 = GhPythonScript(layer_name=cull_2)  # -> out, transmittance, name
# ---------- python_3: Python ----------
__author__ = "mm1013"
__version__ = "2022.01.16"

import rhinoscriptsyntax as rs

try:
    transmittance = layer_name.split("_")[-1].replace("%","")
    name = layer_name.replace("%","")
except:
    transmittance = None
    name = None
# ---------- end python_3 ----------
clean = CleanTree(
    RemoveNulls=True,
    RemoveInvalid=True,
    RemoveEmpty=True,
    Tree=simplify(cull),
    SynchronousTree1=simplify(python_3.name),
    SynchronousTree2=simplify(python_3.transmittance))  # -> Tree, SynchronousTree1, SynchronousTree2
python_4 = GhPythonScript(x=clean.SynchronousTree1)  # -> a
# ---------- python_4: Python ----------
__author__ = "mm1013"
__version__ = "2022.09.02"

import rhinoscriptsyntax as rs

a = x[1:]
# ---------- end python_4 ----------
meshit2 = MeshIt2(mesh_brep=graft(clean.Tree))
name = Text(python_4)
panel_19 = Panel(name)
unflatten = UnflattenTree(Tree=meshit2, Guide=clean.Tree)
geo_2 = Geometry(unflatten)
transmittance = Number(expr("x/100", clean.SynchronousTree2))
concat = Concatenate(FragmentA=panel_19, FragmentB="_mat")
mesh = Mesh(geo_2)

# ----
# opaque geometries
cull_3 = CullPattern(List=graft(layer_name), CullPattern=graft(python_2.is_opaque))  # -> simplify(List)
cull_4 = CullPattern(List=geo, CullPattern=graft(python_2.is_opaque))  # -> simplify(List)
python_5 = GhPythonScript(layer_name=cull_3)  # -> out, reflectance
# ---------- python_5: Python ----------
__author__ = "mm1013"
__version__ = "2022.01.16"

import rhinoscriptsyntax as rs
try:
    reflectance = layer_name.split("_")[-1]
    
except:
    reflectance = None
# ---------- end python_5 ----------
clean_2 = CleanTree(
    RemoveNulls=True,
    RemoveInvalid=True,
    RemoveEmpty=True,
    Tree=cull_3,
    SynchronousTree1=cull_4,
    SynchronousTree2=python_5.reflectance)  # -> Tree, SynchronousTree1, SynchronousTree2
name_2 = Text(clean_2.Tree)
geo_3 = Geometry(clean_2.SynchronousTree1)
refl = Number(clean_2.SynchronousTree2)
python_6 = GhPythonScript(x=name_2)  # -> a; same code as python_4
meshit2_2 = MeshIt2(mesh_brep=geo_3)
concat_2 = Concatenate(FragmentA=python_6, FragmentB="_mat")

# ----
# Grid
cull_5 = CullPattern(List=graft(layer_name), CullPattern=graft(python_2.is_grid))  # -> simplify(List)
cull_6 = CullPattern(List=geo, CullPattern=python_2.is_grid)
clean_3 = CleanTree(RemoveNulls=True, RemoveInvalid=True, RemoveEmpty=True, Tree=cull_5, SynchronousTree1=simplify(cull_6))  # -> Tree, SynchronousTree1
geo_4 = Geometry(graft(clean_3.SynchronousTree1))

# ----
# Read more
# 
# 
# Ambient cache
# https://discourse.radiance-online.org/t/what-data-does-ambfile-store/4785/2
# Vertex order (and normal)
# 
# source : https://www.radiance-online.org/learning/tutorials/Tutorial-ThreePhaseMethod.pdf
# FILE NAMES: *.vmx - view matrix (data)
# *.hdr - view matrix (renderings)
# *.dmx - daylight matrix
# *.skv - sky vector
# *.smx – sky matrix
# *.xml - transmission matrix (the file is xml format)
# 
# *.rad - radiance scene data
# *.oct - octree file
# *.vf - view file
# *.dat - data
# 
# source : https://www.radiance-online.org/learning/tutorials/Tutorial-ThreePhaseMethod.pdf
image = ImageSampler(Filter="Colour", Interpolate=True, Umax=1, Umin=0, Vmax=1, Vmin=0, Wrap=1)  # disabled
panel_20 = Panel(logviewer_2.CurrentTasks)
largest_brep = LargestBREP(window_breps=[<geometry referenced from the Rhino model> x224])

overrides_2 = ApplyOverrides(Input="<projfolder>/radFiles")  # -> Output, Pairs
overrides_3 = ApplyOverrides(Input="<projfolder>")  # -> Output, Pairs

# ----
# Create working folder
panel_21 = Panel("mkdir -p <proj>;echo <proj>")
prep_octrees = LBFalseStartToggle(False)
overrides_4 = ApplyOverrides(Input_=panel_21)  # -> Output, Pairs
executessh = ExecuteSSH(
    _SSHCommands_=overrides_4.Output,
    Run=prep_octrees,
    addPrefix=True,
    description="mkdir -p ~/simulation/boston;echo ~/simulation/boston",
    fireLogs=True,
    lastRunTime=6,
    name="Create workingdir",
    suppressWarnings=False,
    results="/home/mss/simulation/boston",
    commands="mkdir -p ~/simulation/boston;echo ~/simulation/boston")  # -> Stdout, Stderr_, Ran

# ----
# Opaque geometry
panel_22 = Panel("mapping_opaque")
modnames = Text(concat_2)
names = Text(python_6)
mesh_2 = Mesh(meshit2_2)
mesh2obj = MeshToObj(
    Mesh=mesh_2,
    Name=graft(names),
    MapFileName=panel_22,
    ModifierName=graft(modnames),
    SubfolderOverride=overrides_3.Output,
    Run=executessh.Ran)  # -> ObjFiles, MapFile, Run
obj2rad = ObjToRad(
    ObjFiles=mesh2obj.ObjFiles,
    MapFile=mesh2obj.MapFile,
    SubfolderOverride=overrides_2.Output,
    Run=mesh2obj.Run,
    stdouts="~/simulation/boston/radFiles/SkylightWall_70.rad>JOIN<~/simulation/boston/radFiles/SlabCeiling_80.rad>JOIN<~/simulation/boston/radFiles/SlabFloor_30.rad>JOIN<~/simulation/boston/radFiles/SlabWall_50.rad>JOIN<~/simulation/boston/radFiles/SlabJ_50.rad>JOIN<~/simulation/boston/radFiles/WallExterior_50.rad>JOIN<~/simulation/boston/radFiles/Roofs_50.rad>JOIN<~/simulation/boston/radFiles/Doors_50.rad>JOIN<~/simulation/boston/radFiles/FramesCW_50.rad>JOIN<~/simulation/boston/radFiles/FacadeBright_70.rad>JOIN<~/simulation/boston/radFiles/ContextBright_70.rad>JOIN<~/simulation/boston/radFiles/WallInterior_70.rad>JOIN<~/simulation/boston/radFiles/FacadeDark_30.rad>JOIN<~/simulation/boston/radFiles/Frames_50.rad")  # -> Status, RadFiles, Run
opaque_rad = Text(obj2rad.RadFiles)
panel_23 = Panel(opaque_rad)

# ----
# rad files
# Window geometry
panel_24 = Panel("mapping_windows")
mesh2obj_2 = MeshToObj(
    Mesh=mesh,
    Name=graft(panel_19),
    MapFileName=panel_24,
    ModifierName=graft(concat),
    SubfolderOverride=overrides_3.Output,
    Run=executessh.Ran)  # -> ObjFiles, MapFile, Run
obj2rad_2 = ObjToRad(
    ObjFiles=mesh2obj_2.ObjFiles,
    MapFile=mesh2obj_2.MapFile,
    SubfolderOverride=overrides_2.Output,
    Run=mesh2obj_2.Run,
    stdouts="~/simulation/boston/radFiles/GlassTak_70.rad>JOIN<~/simulation/boston/radFiles/GlassInt_74.rad>JOIN<~/simulation/boston/radFiles/GlassFacade_74.rad>JOIN<~/simulation/boston/radFiles/GlassBSDF_70.rad")  # -> Status, RadFiles, Run
window_rad = Text(obj2rad_2.RadFiles)

# ----
# opaque materials
panel_25 = Panel("echo \"<mats>\" > <proj>/radFiles/<target>;echo \"<proj>/radFiles/<target>\"")
opaquegreymat = OpaqueGreyMat(Name=concat_2, Reflectance_0_1=refl, Specularity=0, Roughness=0)  # -> flatten(RadMaterials), RadMaterialList
join_2 = TextJoin(Text=opaquegreymat.RadMaterials)
overrides_5 = ApplyOverrides(Input_=panel_25, Mats=graft(join_2), Target=graft("opaque_materials.mat"))  # -> Output, Pairs
executessh_wip_3 = ExecuteSSHWIP(
    _SSHCommands_=overrides_5.Output,
    Run=obj2rad.Run,
    addPrefix=True,
    description="""echo "void plastic ContextBright_70_mat
0
0
5 0.700 0.700 0.700 0.000 0.000
void plastic FacadeBright_70_mat
0
0
5 0.700 0.700 0.700 0.000 0.000
void plastic Frames_50_mat
0
0
5 0.500 0.500 0.500 0.000 0.000
void plastic FramesCW_50_mat
0
0
5 0.500 0.500 0.500 0.000 0.000
void plastic WallInterior_70_mat
0
0
5 0.700 0.700 0.700 0.000 0.000
void plastic Doors_50_mat
0
0
5 0.500 0.500 0.500 0.000 0.000
void plastic Roofs_50_mat
0
0
5 0.500 0.500 0.500 0.000 0.000
void plastic WallExterior_50_mat
0
0
5 0.500 0.500 0.500 0.000 0.000
void plastic SlabJ_50_mat
0
0
5 0.500 0.500 0.500 0.000 0.000
void plastic SlabWall_50_mat
0
0
5 0.500 0.500 0.500 0.000 0.000
void plastic SlabFloor_30_mat
0
0
5 0.300 0.300 0.300 0.000 0.000
void plastic SlabCeiling_80_mat
0
0
5 0.800 0.800 0.800 0.000 0.000
void plastic SkylightWall_70_mat
0
0
5 0.700 0.700 0.700 0.000 0.000
void plastic FacadeDark_30_mat
0
0
5 0.300 0.300 0.300 0.000 0.000" > ~/simulation/boston/radFiles/opaque_materials.mat;echo "~/simulation/boston/radFiles/opaque_materials.mat"
""",
    fireLogs=True,
    lastRunTime=27,
    name="opaqueMats",
    suppressWarnings=False,
    results="~/simulation/boston/radFiles/opaque_materials.mat",
    commands="""echo "void plastic Frames_50_mat
0
0
5 0.500 0.500 0.500 0.000 0.000
void plastic FacadeDark_30_mat
0
0
5 0.300 0.300 0.300 0.000 0.000
void plastic WallInterior_70_mat
0
0
5 0.700 0.700 0.700 0.000 0.000
void plastic ContextBright_70_mat
0
0
5 0.700 0.700 0.700 0.000 0.000
void plastic FacadeBright_70_mat
0
0
5 0.700 0.700 0.700 0.000 0.000
void plastic FramesCW_50_mat
0
0
5 0.500 0.500 0.500 0.000 0.000
void plastic Doors_50_mat
0
0
5 0.500 0.500 0.500 0.000 0.000
void plastic Roofs_50_mat
0
0
5 0.500 0.500 0.500 0.000 0.000
void plastic WallExterior_50_mat
0
0
5 0.500 0.500 0.500 0.000 0.000
void plastic SlabJ_50_mat
0
0
5 0.500 0.500 0.500 0.000 0.000
void plastic SlabWall_50_mat
0
0
5 0.500 0.500 0.500 0.000 0.000
void plastic SlabFloor_30_mat
0
0
5 0.300 0.300 0.300 0.000 0.000
void plastic SlabCeiling_80_mat
0
0
5 0.800 0.800 0.800 0.000 0.000
void plastic SkylightWall_70_mat
0
0
5 0.700 0.700 0.700 0.000 0.000" > ~/simulation/boston/radFiles/opaque_materials.mat;echo "~/simulation/boston/radFiles/opaque_materials.mat"
""")  # -> Stdout, Stderr_, Ran
opaque_mat = Text(executessh_wip_3.Stdout)

# ----
# Setup glass materials
panel_26 = Panel("<mat>.mat")
python_7 = GhPythonScript(matname=concat)  # -> filename
# ---------- python_7: Python ----------
__author__ = "mm1013"
__version__ = "2022.07.06"

import rhinoscriptsyntax as rs

filename = matname.replace(" ","_").replace(".","_")
# ---------- end python_7 ----------
glassmat = GlassMat(Name=concat, Transmittance_0_1=transmittance)  # -> RadMaterials, RadMaterialList
# materials
panel_27 = Panel("echo \"<mats>\" > <proj>/radFiles/<target>;echo \"<proj>/radFiles/<target>\"")
overrides_6 = ApplyOverrides(Input_=panel_26, Mat=graft(python_7))  # -> Output, Pairs
overrides_7 = ApplyOverrides(Input_=panel_27, Mats=graft(glassmat.RadMaterials), Target=graft(overrides_6.Output))  # -> Output, Pairs
executessh_wip_4 = ExecuteSSHWIP(
    _SSHCommands_=overrides_7.Output,
    Run=obj2rad.Run,
    addPrefix=True,
    description="""echo "void glass GlassFacade_74_mat
0
0
3 0.806 0.806 0.806" > ~/simulation/boston/radFiles/GlassFacade_74_mat.mat;echo "~/simulation/boston/radFiles/GlassFacade_74_mat.mat"


- - -

echo "void glass GlassInt_74_mat
0
0
3 0.806 0.806 0.806" > ~/simulation/boston/radFiles/GlassInt_74_mat.mat;echo "~/simulation/boston/radFiles/GlassInt_74_mat.mat"


- - -

echo "void glass GlassTak_70_mat
0
0
3 0.763 0.763 0.763" > ~/simulation/boston/radFiles/GlassTak_70_mat.mat;echo "~/simulation/boston/radFiles/GlassTak_70_mat.mat"
""",
    fireLogs=True,
    lastRunTime=27,
    name="glassMats",
    suppressWarnings=False,
    results=["~/simulation/boston/radFiles/GlassBSDF_70_mat.mat", "~/simulation/boston/radFiles/GlassFacade_74_mat.mat", "~/simulation/boston/radFiles/GlassInt_74_mat.mat", "~/simulation/boston/radFiles/GlassTak_70_mat.mat"],
    commands="""echo "void glass GlassFacade_74_mat
0
0
3 0.806 0.806 0.806" > ~/simulation/boston/radFiles/GlassFacade_74_mat.mat;echo "~/simulation/boston/radFiles/GlassFacade_74_mat.mat"
""")  # -> Stdout, Stderr_, Ran
window_mat = Text(flatten(executessh_wip_4.Stdout))

# ----
# Octrees
# STANDARD octree
window_mat_2 = Text(window_mat)
opaque_mat_2 = Text(opaque_mat)
opaque_rad_2 = Text(opaque_rad)
window_rad_2 = Text(window_rad)
entwine = Entwine(Branch00=window_mat_2, Branch01=window_rad_2, Branch02=opaque_mat_2, Branch03=opaque_rad_2, FlattenInputs=True)  # -> flatten(Result)

entwine_2 = Entwine(Branch00=opaque_mat_2, Branch01=opaque_rad_2, FlattenInputs=True)
entwine_3 = Entwine(Branch00=window_mat_2, Branch01=window_rad_2, FlattenInputs=True)

# ----
# 10klx overcast sky (RwR p357)
# # start of sky definition for daylighting studies
# # location name: COPENHAGEN_DNK LAT: 55.63
# !gensky 5 14 14.0 -c -a 55.63 -o -12.67 -m -15.0 | xform -rz 0.0
# skyfunc glow sky_mat
# 0
# 0
# 4
# 1 1 1 0
# sky_mat source sky
# 0
# 0
# 4
# 0 0 1 180
# skyfunc glow ground_glow
# 0
# 0
# 4
# 1 .8 .5 0
# ground_glow source ground
# 0
# 0
# 4
# 0 0 -1 180
# # end of sky definition for daylighting studies
falsestart = LBFalseStartToggle(False)
bool = Boolean(falsestart)
and_append_the_ground = Panel("""##The 1 will be multiplie with brightfunc
skyfunc glow sky_glow
0
0
4 1 1 1 0

##Set to 1 as it will be multiplied with the gensky result
sky_glow source sky
0
0
4 0 0 1 180

##Set to 1 as it will be multiplied with the gensky result
skyfunc glow ground_glow
0
0
4 1 1 1 0

##The ground pane
ground_glow source ground
0
0
4 0 0 -1 180""")
execute_ssh_async = ExecuteSSHAsync(
    _SSHCommands_="gensky -ang 45 0 -c -B 55.866",
    Run=bool,
    addPrefix=True,
    addSuffix=True,
    description="gensky -ang 45 0 -c -B 55.866",
    fireLogs=False,
    stdouts="""# gensky -ang 45 0 -c -B 55.866
# Ground ambient level: 17.8

void brightfunc skyfunc
2 skybr skybright.cal
0
3 2 2.29e+01 3.56e+00""",
    suppressWarnings=False)  # -> Stdout, Stderr_, port, port_2, Ran
concat_3 = Concatenate(FragmentC="##Will control the gradient of the sky", FragmentA=execute_ssh_async.Stdout, FragmentB=and_append_the_ground)
panel_28 = Panel(concat_3)
panel_29 = Panel("""mkdir -p <proj>/skies/
echo "<sky>" > <proj>/skies/<target>
echo "<proj>/skies/<target>"
""")
overrides_8 = ApplyOverrides(Input=panel_29, Sky=graft(panel_28), Target=graft("overcast_sky.rad"))  # -> Output, Pairs
execute_ssh_async_2 = ExecuteSSHAsync(
    _SSHCommands_=overrides_8.Output,
    Run=execute_ssh_async.Ran,
    addPrefix=True,
    addSuffix=True,
    description="""mkdir -p ~/simulation/boston/skies/;echo "##Will control the gradient of the sky
# gensky -ang 45 0 -c -B 55.866
# Ground ambient level: 17.8

void brightfunc skyfunc
2 skybr skybright.cal
0
3 2 2.29e+01 3.56e+00

##The 1 will be multiplie with brightfunc
skyfunc glow sky_glow
0
0
4 1 1 1 0

##Set to 1 as it will be multiplied with the gensky result
sky_glow source sky
0
0
4 0 0 1 180

##Set to 1 as it will be multiplied with the gensky result
skyfunc glow ground_glow
0
0
4 1 1 1 0

##The ground pane
ground_glow source ground
0
0
4 0 0 -1 180" > ~/simulation/boston/skies/overcast_sky.rad;echo "~/simulation/boston/skies/overcast_sky.rad"
""",
    fireLogs=False,
    stdouts="~/simulation/boston/skies/overcast_sky.rad",
    suppressWarnings=False)  # -> Stdout, Stderr_, port, port_2, Ran
panel_30 = Panel(execute_ssh_async_2.Stdout)

# ----
# preview rad files
convertpaths = ConvertPaths(I=flatten(entwine_3))  # -> Linux, Windows
convertpaths_2 = ConvertPaths(I=entwine_2)  # -> Linux, Windows
radviewer = RadViewer(
    RadFiles=flatten(convertpaths.Windows),
    DisplayName="Windows",
    IsTwoSided=False,
    Polychromatic=True,
    ShowEdges=True,
    Transparent=True,
    ColorNames=["GlassTak_70_mat", "GlassInt_74_mat", "GlassFacade_74_mat", "GlassBSDF_70_mat", "SkylightWall_70_mat", "SlabCeiling_80_mat", "SlabFloor_30_mat", "SlabWall_50_mat", "SlabJ_50_mat", "WallExterior_50_mat", "Roofs_50_mat", "Doors_50_mat", "FramesCW_50_mat", "FacadeBright_70_mat", "ContextBright_70_mat", "WallInterior_70_mat", "FacadeDark_30_mat", "Frames_50_mat"],
    Colors=[RGB(177, 203, 218), RGB(149, 243, 118), RGB(218, 247, 105), RGB(165, 199, 252), RGB(100, 251, 165), RGB(203, 230, 172), RGB(169, 243, 224), RGB(238, 176, 232), RGB(242, 222, 239), RGB(146, 222, 239), RGB(144, 119, 233), RGB(174, 245, 124), RGB(120, 214, 159), RGB(156, 153, 225), RGB(117, 221, 150), RGB(184, 150, 138), RGB(158, 205, 172), RGB(189, 132, 143)])  # -> Geo, ModifierNames, Modifiers, FailedWireFrame
radviewer_2 = RadViewer(
    RadFiles=flatten(convertpaths_2.Windows),
    DisplayName="Opaque",
    IsTwoSided=False,
    Polychromatic=True,
    ShowEdges=True,
    Transparent=True,
    ColorNames=["GlassTak_70_mat", "GlassInt_74_mat", "GlassFacade_74_mat", "GlassBSDF_70_mat", "SkylightWall_70_mat", "SlabCeiling_80_mat", "SlabFloor_30_mat", "SlabWall_50_mat", "SlabJ_50_mat", "WallExterior_50_mat", "Roofs_50_mat", "Doors_50_mat", "FramesCW_50_mat", "FacadeBright_70_mat", "ContextBright_70_mat", "WallInterior_70_mat", "FacadeDark_30_mat", "Frames_50_mat"],
    Colors=[RGB(177, 203, 218), RGB(149, 243, 118), RGB(218, 247, 105), RGB(165, 199, 252), RGB(100, 251, 165), RGB(203, 230, 172), RGB(169, 243, 224), RGB(238, 176, 232), RGB(242, 222, 239), RGB(146, 222, 239), RGB(144, 119, 233), RGB(174, 245, 124), RGB(120, 214, 159), RGB(156, 153, 225), RGB(117, 221, 150), RGB(184, 150, 138), RGB(158, 205, 172), RGB(189, 132, 143)])  # -> Geo, ModifierNames, Modifiers, FailedWireFrame

overrides_9 = ApplyOverrides(Input="cat <target>", Target=graft(execute_ssh_async_2.Stdout))  # -> Output, Pairs
execute_ssh_async_3 = ExecuteSSHAsync(
    _SSHCommands_=overrides_9.Output,
    Run=execute_ssh_async_2.Ran,
    addPrefix=True,
    addSuffix=True,
    description="cat ~/simulation/boston/skies/overcast_sky.rad",
    fireLogs=False,
    stdouts="""##Will control the gradient of the sky
# gensky -ang 45 0 -c -B 55.866
# Ground ambient level: 17.8

void brightfunc skyfunc
2 skybr skybright.cal
0
3 2 2.29e+01 3.56e+00

##The 1 will be multiplie with brightfunc
skyfunc glow sky_glow
0
0
4 1 1 1 0

##Set to 1 as it will be multiplied with the gensky result
sky_glow source sky
0
0
4 0 0 1 180

##Set to 1 as it will be multiplied with the gensky result
skyfunc glow ground_glow
0
0
4 1 1 1 0

##The ground pane
ground_glow source ground
0
0
4 0 0 -1 180""",
    suppressWarnings=False)  # -> Stdout, Stderr_, port, port_2, Ran
panel_31 = Panel(execute_ssh_async_3.Stdout)

falsestart_2 = LBFalseStartToggle(False)

# ----
# OCTREE (overcast)
scene_rads = Text(entwine)
sky_ovc = Text(execute_ssh_async_2.Stdout)
python_8 = GhPythonScript(x=flatten(scene_rads))  # -> a; inputs x: list
# ---------- python_8: Python ----------
__author__ = "mm1013"
__version__ = "2022.06.15"

import rhinoscriptsyntax as rs

a = None not in x
# ---------- end python_8 ----------
entwine_4 = Entwine(Branch01=sky_ovc, Branch02=scene_rads, FlattenInputs=True)  # -> flatten(Radfiles)
panel_32 = Panel("""mkdir -p <proj>/octrees/
oconv -r 2048 -w -f <rads> > <proj>/octrees/<target>
echo <proj>/octrees/<target>""")
and = GateAnd(A=python_8, B=falsestart_2)
join_3 = TextJoin(Text=entwine_4, Join=" ")
overrides_10 = ApplyOverrides(Input=panel_32, Rads=graft(join_3), Target=graft("my_test_scene.oct"))  # -> Output, Pairs
executessh_2 = ExecuteSSH(
    _SSHCommands_=overrides_10.Output,
    Run=and,
    addPrefix=True,
    description="""mkdir -p ~/simulation/boston/octrees/
oconv -r 2048 -w -f ~/simulation/boston/skies/overcast_sky.rad ~/simulation/boston/radFiles/GlassBSDF_70_mat.mat ~/simulation/boston/radFiles/GlassFacade_74_mat.mat ~/simulation/boston/radFiles/GlassInt_74_mat.mat ~/simulation/boston/radFiles/GlassTak_70.rad ~/simulation/boston/radFiles/GlassInt_74.rad ~/simulation/boston/radFiles/GlassFacade_74.rad ~/simulation/boston/radFiles/GlassBSDF_70.rad ~/simulation/boston/radFiles/opaque_materials.mat ~/simulation/boston/radFiles/SkylightWall_70.rad ~/simulation/boston/radFiles/SlabCeiling_80.rad ~/simulation/boston/radFiles/SlabFloor_30.rad ~/simulation/boston/radFiles/SlabWall_50.rad ~/simulation/boston/radFiles/SlabJ_50.rad ~/simulation/boston/radFiles/WallExterior_50.rad ~/simulation/boston/radFiles/Roofs_50.rad ~/simulation/boston/radFiles/Doors_50.rad ~/simulation/boston/radFiles/FramesCW_50.rad ~/simulation/boston/radFiles/FacadeBright_70.rad ~/simulation/boston/radFiles/ContextBright_70.rad ~/simulation/boston/radFiles/WallInterior_70.rad ~/simulation/boston/radFiles/FacadeDark_30.rad ~/simulation/boston/radFiles/Frames_50.rad > ~/simulation/boston/octrees/my_test_scene.oct
echo ~/simulation/boston/octrees/my_test_scene.oct""",
    fireLogs=False,
    lastRunTime=12460,
    suppressWarnings=False)  # -> Stdout, Stderr_, Ran
convertpaths_3 = ConvertPaths(I=executessh_2.Stdout)  # -> Linux, Windows
panel_33 = Panel(executessh_2.Stdout)
panel_34 = Panel(convertpaths_3.Windows)
octree_overcast = Text(executessh_2.Stdout)

button = Button()

view = CreateView(Viewport="Perspective", Update=button)  # -> ViewfileContent, ImageRatio
panel_35 = Panel(view.ViewfileContent)

resolution = ValueList({"750x330": 750, "1500x750": 1500, "3000x1500": 3000, "5000x2500": 5000, "7000x3500": 7000, "8000x4000": 8000, "16000x8000": 16000, "20000x12000": 20000}, selected="750x330")
x = Number(resolution)

resolution_2 = ValueList({"750x330": 750, "1500x750": 1500, "3000x1500": 3000, "5000x2500": 5000, "7000x3500": 7000, "8000x4000": 8000, "16000x8000": 16000, "20000x12000": 20000}, selected="7000x3500")
x_2 = Number(resolution_2)

panel_36 = Panel("-ab 3 -ad 2048")

# ----
# Preview a RAD file with objpict
# can also use ra_tiff/normtiff/pfilt
# gamma will vary
# 
# check axel jacobs radiance tutorial p26
panel_37 = Panel("""mkdir -p <proj>/images/
objpict <rad> > <proj>/images/<target-.>.hdr
normtiff <proj>/images/<target-.>.hdr <proj>/images/<target-.>.tif
convert <proj>/images/<target-.>.tif <proj>/images/<target>
echo <proj>/images/<target>""")
radfile = Text(flatten(entwine))
list = ItemSelector(
    radfile,
    {"~/simulation/boston/radFiles/GlassBSDF_70_mat.mat", "~/simulation/boston/radFiles/GlassFacade_74_mat.mat", "~/simulation/boston/radFiles/GlassInt_74_mat.mat", "~/simulation/boston/radFiles/GlassTak_70.rad", "~/simulation/boston/radFiles/GlassInt_74.rad", "~/simulation/boston/radFiles/GlassFacade_74.rad", "~/simulation/boston/radFiles/GlassBSDF_70.rad", "~/simulation/boston/radFiles/opaque_materials.mat", "~/simulation/boston/radFiles/SkylightWall_70.rad", "~/simulation/boston/radFiles/SlabCeiling_80.rad", "~/simulation/boston/radFiles/SlabFloor_30.rad", "~/simulation/boston/radFiles/SlabWall_50.rad", "~/simulation/boston/radFiles/SlabJ_50.rad", "~/simulation/boston/radFiles/WallExterior_50.rad", "~/simulation/boston/radFiles/Roofs_50.rad", "~/simulation/boston/radFiles/Doors_50.rad", "~/simulation/boston/radFiles/FramesCW_50.rad", "~/simulation/boston/radFiles/FacadeBright_70.rad", "~/simulation/boston/radFiles/ContextBright_70.rad", "~/simulation/boston/radFiles/WallInterior_70.rad", "~/simulation/boston/radFiles/FacadeDark_30.rad", "~/simulation/boston/radFiles/Frames_50.rad"}, selected=["~/simulation/boston/radFiles/SkylightWall_70.rad", "~/simulation/boston/radFiles/Roofs_50.rad"])
panel_38 = Panel("""rad
target""")
falsestart_3 = LBFalseStartToggle(False)

join_4 = TextJoin(Text=list, Join=" ")

overrides_11 = ApplyOverrides(Input_=panel_37, Rad=graft(join_4), Target=graft("quickRender.png"))  # -> Output, Pairs
execute_ssh_async_4 = ExecuteSSHAsync(
    _SSHCommands_=overrides_11.Output,
    Run=falsestart_3,
    addPrefix=True,
    addSuffix=True,
    description="mkdir -p ~/simulation/boston/images/;objpict ~/simulation/boston/radFiles/opaque_materials.mat ~/simulation/boston/radFiles/WallExterior_50.rad > ~/simulation/boston/images/quickRender.hdr;normtiff ~/simulation/boston/images/quickRender.hdr ~/simulation/boston/images/quickRender.tif;convert ~/simulation/boston/images/quickRender.tif ~/simulation/boston/images/quickRender.png;echo ~/simulation/boston/images/quickRender.png",
    fireLogs=False,
    stdouts="/home/mss/simulation/boston/images/quickRender.png",
    suppressWarnings=False)  # -> Stdout, Stderr_, port, port_2, Ran

executessh_wip_5 = ExecuteSSHWIP(
    _SSHCommands=overrides_11.Output,
    Run=falsestart_3,
    addPrefix=True,
    description="""mkdir -p ~/simulation/boston/images/
objpict ~/simulation/boston/radFiles/SkylightWall_70.rad ~/simulation/boston/radFiles/Roofs_50.rad > ~/simulation/boston/images/quickRender.hdr
normtiff ~/simulation/boston/images/quickRender.hdr ~/simulation/boston/images/quickRender.tif
convert ~/simulation/boston/images/quickRender.tif ~/simulation/boston/images/quickRender.png
echo ~/simulation/boston/images/quickRender.png""",
    fireLogs=False,
    lastRunTime=1140,
    suppressWarnings=True,
    results="""_JOIN_
_JOIN_
_JOIN_
_JOIN_
/home/mss/simulation/boston/images/quickRender.png""",
    stderr="""getbbox: warning - zero area for polygon "WallExterior_50_1.111"
getbbox: warning - zero area for polygon "WallExterior_50_1.112"
getbbox: warning - zero area for polygon "WallExterior_50_1.5160"
getbbox: warning - zero area for polygon "WallExterior_50_1.5163"
getbbox: warning - zero area for polygon "WallExterior_50_1.5190"
getbbox: warning - zero area for polygon "WallExterior_50_1.5222"
getbbox: warning - zero area for polygon "WallExterior_50_1.5303"
getbbox: warning - zero area for polygon "WallExterior_50_1.5314"
getbbox: warning - zero area for polygon "WallExterior_50_1.5315"
getbbox: warning - zero area for polygon "WallExterior_50_1.5316"
getbbox: warning - zero area for polygon "WallExterior_50_1.5321"
getbbox: warning - zero area for polygon "WallExterior_50_1.5323"
oconv: warning - zero area for polygon "WallExterior_50_1.111"
oconv: warning - zero area for polygon "WallExterior_50_1.112"
oconv: warning - zero area for polygon "WallExterior_50_1.5160"
oconv: warning - zero area for polygon "WallExterior_50_1.5163"
oconv: warning - zero area for polygon "WallExterior_50_1.5190"
oconv: warning - zero area for polygon "WallExterior_50_1.5222"
oconv: warning - zero area for polygon "WallExterior_50_1.5303"
oconv: warning - zero area for polygon "WallExterior_50_1.5314"
oconv: warning - zero area for polygon "WallExterior_50_1.5315"
oconv: warning - zero area for polygon "WallExterior_50_1.5316"
oconv: warning - zero area for polygon "WallExterior_50_1.5321"
oconv: warning - zero area for polygon "WallExterior_50_1.5323"
""",
    commands="""mkdir -p ~/simulation/boston/images/
_JOIN_
objpict ~/simulation/boston/radFiles/opaque_materials.mat ~/simulation/boston/radFiles/WallExterior_50.rad > ~/simulation/boston/images/quickRender.hdr
_JOIN_
normtiff ~/simulation/boston/images/quickRender.hdr ~/simulation/boston/images/quickRender.tif
_JOIN_
convert ~/simulation/boston/images/quickRender.tif ~/simulation/boston/images/quickRender.png
_JOIN_
echo ~/simulation/boston/images/quickRender.png""")  # -> Stdout, Stderr, Ran

convertpaths_4 = ConvertPaths(I=executessh_wip_5.Stdout)  # -> Linux, Windows
imageviewer = LBImageViewer(ImagePath_=convertpaths_4.Windows, _scale_=1, DisableClickable=False, SaveImgWithCoords=False, scale=1)  # -> ImagePath, Values, GIF

# ----
# sunny sky (SET LAT AND LON)
panel_39 = Panel("gensky 7 4 <h>:00CEST +s -a <lat> -o <lon>")
falsestart_4 = LBFalseStartToggle(False)
# 5 phase bash script from andy mcneil
# Colored skies! Why not?
# from https://discourse.radiance-online.org/t/new-tool-for-generating-colored-sky/5891
series = Series(Start=8, Step=1, Count=10)
bool_2 = Boolean(falsestart_4)
overrides_12 = ApplyOverrides(Input_=panel_39, Lat=graft("59.9"), Lon=graft("10.7"), H=graft(series))  # -> Output, Pairs
and_append_the_ground_2 = Panel("""##The 1 will be multiplie with brightfunc
skyfunc glow sky_glow
0
0
4 1 1 1 0

##Set to 1 as it will be multiplied with the gensky result
sky_glow source sky
0
0
4 0 0 1 180

##Set to 1 as it will be multiplied with the gensky result
skyfunc glow ground_glow
0
0
4 1 1 1 0

##The ground pane
ground_glow source ground
0
0
4 0 0 -1 180""")
panel_40 = Panel("""mkdir -p <proj>/skies/
echo "<sky>" > <proj>/skies/<target>
echo "<proj>/skies/<target>"
""")
python_9 = GhPythonScript(x=series)  # -> a; inputs x: Int32
# ---------- python_9: Python ----------
__author__ = "mm1013"
__version__ = "2022.08.30"

import rhinoscriptsyntax as rs

a = "%02d00" % x
# ---------- end python_9 ----------
hours = Number(python_9)
hours_2 = Text(python_9)

executessh_wip_6 = ExecuteSSHWIP(
    _SSHCommands_=overrides_12.Output,
    Run=bool_2,
    addPrefix=True,
    description="""gensky 7 4 8:00CEST +s -a 59.9 -o 10.7


- - -

gensky 7 4 9:00CEST +s -a 59.9 -o 10.7


- - -

gensky 7 4 10:00CEST +s -a 59.9 -o 10.7


- - -

gensky 7 4 11:00CEST +s -a 59.9 -o 10.7


- - -

gensky 7 4 12:00CEST +s -a 59.9 -o 10.7


- - -

gensky 7 4 13:00CEST +s -a 59.9 -o 10.7


- - -

gensky 7 4 14:00CEST +s -a 59.9 -o 10.7


- - -

gensky 7 4 15:00CEST +s -a 59.9 -o 10.7


- - -

gensky 7 4 16:00CEST +s -a 59.9 -o 10.7


- - -

gensky 7 4 17:00CEST +s -a 59.9 -o 10.7""",
    fireLogs=True,
    lastRunTime=85,
    name="Sunny skies",
    suppressWarnings=False)  # -> Stdout, Stderr_, Ran

panel_41 = Panel(executessh_wip_6.Stdout)
concat_4 = Concatenate(FragmentC="##Will control the gradient of the sky", FragmentA=executessh_wip_6.Stdout, FragmentB=and_append_the_ground_2)
overrides_13 = ApplyOverrides(Input=panel_40, Sky=graft(concat_4), Target=graft("sunny_sky_<h>.rad"), H=graft(series))  # -> Output, Pairs

executessh_wip_7 = ExecuteSSHWIP(
    _SSHCommands_=overrides_13.Output,
    Run=executessh_wip_6.Ran,
    addPrefix=True,
    description="""mkdir -p ~/simulation/boston/skies/
echo "##Will control the gradient of the sky


##The 1 will be multiplie with brightfunc
skyfunc glow sky_glow
0
0
4 1 1 1 0

##Set to 1 as it will be multiplied with the gensky result
sky_glow source sky
0
0
4 0 0 1 180

##Set to 1 as it will be multiplied with the gensky result
skyfunc glow ground_glow
0
0
4 1 1 1 0

##The ground pane
ground_glow source ground
0
0
4 0 0 -1 180" > ~/simulation/boston/skies/sunny_sky_8.rad
echo "~/simulation/boston/skies/sunny_sky_8.rad"


- - -

mkdir -p ~/simulation/boston/skies/
echo "##Will control the gradient of the sky


##The 1 will be multiplie with brightfunc
skyfunc glow sky_glow
0
0
4 1 1 1 0

##Set to 1 as it will be multiplied with the gensky result
sky_glow source sky
0
0
4 0 0 1 180

##Set to 1 as it will be multiplied with the gensky result
skyfunc glow ground_glow
0
0
4 1 1 1 0

##The ground pane
ground_glow source ground
0
0
4 0 0 -1 180" > ~/simulation/boston/skies/sunny_sky_9.rad
echo "~/simulation/boston/skies/sunny_sky_9.rad"


- - -

mkdir -p ~/simulation/boston/skies/
echo "##Will control the gradient of the sky


##The 1 will be multiplie with brightfunc
skyfunc glow sky_glow
0
0
4 1 1 1 0

##Set to 1 as it will be multiplied with the gensky result
sky_glow source sky
0
0
4 0 0 1 180

##Set to 1 as it will be multiplied with the gensky result
skyfunc glow ground_glow
0
0
4 1 1 1 0

##The ground pane
ground_glow source ground
0
0
4 0 0 -1 180" > ~/simulation/boston/skies/sunny_sky_10.rad
echo "~/simulation/boston/skies/sunny_sky_10.rad"


- - -

mkdir -p ~/simulation/boston/skies/
echo "##Will control the gradient of the sky


##The 1 will be multiplie with brightfunc
skyfunc glow sky_glow
0
0
4 1 1 1 0

##Set to 1 as it will be multiplied with the gensky result
sky_glow source sky
0
0
4 0 0 1 180

##Set to 1 as it will be multiplied with the gensky result
skyfunc glow ground_glow
0
0
4 1 1 1 0

##The ground pane
ground_glow source ground
0
0
4 0 0 -1 180" > ~/simulation/boston/skies/sunny_sky_11.rad
echo "~/simulation/boston/skies/sunny_sky_11.rad"


- - -

mkdir -p ~/simulation/boston/skies/
echo "##Will control the gradient of the sky


##The 1 will be multiplie with brightfunc
skyfunc glow sky_glow
0
0
4 1 1 1 0

##Set to 1 as it will be multiplied with the gensky result
sky_glow source sky
0
0
4 0 0 1 180

##Set to 1 as it will be multiplied with the gensky result
skyfunc glow ground_glow
0
0
4 1 1 1 0

##The ground pane
ground_glow source ground
0
0
4 0 0 -1 180" > ~/simulation/boston/skies/sunny_sky_12.rad
echo "~/simulation/boston/skies/sunny_sky_12.rad"


- - -

mkdir -p ~/simulation/boston/skies/
echo "##Will control the gradient of the sky


##The 1 will be multiplie with brightfunc
skyfunc glow sky_glow
0
0
4 1 1 1 0

##Set to 1 as it will be multiplied with the gensky result
sky_glow source sky
0
0
4 0 0 1 180

##Set to 1 as it will be multiplied with the gensky result
skyfunc glow ground_glow
0
0
4 1 1 1 0

##The ground pane
ground_glow source ground
0
0
4 0 0 -1 180" > ~/simulation/boston/skies/sunny_sky_13.rad
echo "~/simulation/boston/skies/sunny_sky_13.rad"


- - -

mkdir -p ~/simulation/boston/skies/
echo "##Will control the gradient of the sky


##The 1 will be multiplie with brightfunc
skyfunc glow sky_glow
0
0
4 1 1 1 0

##Set to 1 as it will be multiplied with the gensky result
sky_glow source sky
0
0
4 0 0 1 180

##Set to 1 as it will be multiplied with the gensky result
skyfunc glow ground_glow
0
0
4 1 1 1 0

##The ground pane
ground_glow source ground
0
0
4 0 0 -1 180" > ~/simulation/boston/skies/sunny_sky_14.rad
echo "~/simulation/boston/skies/sunny_sky_14.rad"


- - -

mkdir -p ~/simulation/boston/skies/
echo "##Will control the gradient of the sky


##The 1 will be multiplie with brightfunc
skyfunc glow sky_glow
0
0
4 1 1 1 0

##Set to 1 as it will be multiplied with the gensky result
sky_glow source sky
0
0
4 0 0 1 180

##Set to 1 as it will be multiplied with the gensky result
skyfunc glow ground_glow
0
0
4 1 1 1 0

##The ground pane
ground_glow source ground
0
0
4 0 0 -1 180" > ~/simulation/boston/skies/sunny_sky_15.rad
echo "~/simulation/boston/skies/sunny_sky_15.rad"


- - -

mkdir -p ~/simulation/boston/skies/
echo "##Will control the gradient of the sky


##The 1 will be multiplie with brightfunc
skyfunc glow sky_glow
0
0
4 1 1 1 0

##Set to 1 as it will be multiplied with the gensky result
sky_glow source sky
0
0
4 0 0 1 180

##Set to 1 as it will be multiplied with the gensky result
skyfunc glow ground_glow
0
0
4 1 1 1 0

##The ground pane
ground_glow source ground
0
0
4 0 0 -1 180" > ~/simulation/boston/skies/sunny_sky_16.rad
echo "~/simulation/boston/skies/sunny_sky_16.rad"


- - -

mkdir -p ~/simulation/boston/skies/
echo "##Will control the gradient of the sky


##The 1 will be multiplie with brightfunc
skyfunc glow sky_glow
0
0
4 1 1 1 0

##Set to 1 as it will be multiplied with the gensky result
sky_glow source sky
0
0
4 0 0 1 180

##Set to 1 as it will be multiplied with the gensky result
skyfunc glow ground_glow
0
0
4 1 1 1 0

##The ground pane
ground_glow source ground
0
0
4 0 0 -1 180" > ~/simulation/boston/skies/sunny_sky_17.rad
echo "~/simulation/boston/skies/sunny_sky_17.rad"
""",
    fireLogs=False,
    lastRunTime=103,
    suppressWarnings=False)  # -> Stdout, Stderr_, Ran
item = ListItem(List=executessh_wip_7.Stdout, Index=0, Wrap=True)  # -> Item1, Item

# ----
# OCTREE (Sunny - 10 hourly skies!)
scene_rads_2 = Text(entwine)
falsestart_5 = LBFalseStartToggle(False)
python_10 = GhPythonScript(x=flatten(scene_rads_2))  # -> a; inputs x: list; same code as python_8
entwine_5 = Entwine(Branch02=scene_rads_2, FlattenInputs=True)  # -> flatten(Radfiles)
panel_42 = Panel("""mkdir -p <proj>/octrees/
oconv -r 2048 -f -w <rads> > <proj>/octrees/<target>
echo <proj>/octrees/<target>""")
and_2 = GateAnd(A=python_10, B=falsestart_5)
join_5 = TextJoin(Text=entwine_5, Join=" ")
panel_43 = Panel("oconv -r 2048 -i <oldOct> -f <newRads> > <proj>/octrees/<target>_<h>.oct;echo <proj>/octrees/<target>_<h>.oct")
overrides_14 = ApplyOverrides(Input=panel_42, Rads=graft(join_5), Target=graft("my_test_scene_NOSKY.oct"))  # -> Output, Pairs
sky_sunny = Text(graft(item.Item1))
executessh_wip_8 = ExecuteSSHWIP(
    _SSHCommands_=overrides_14.Output,
    Run=and_2,
    addPrefix=True,
    description="""mkdir -p ~/simulation/boston/octrees/
oconv -r 2048 -f -w ~/simulation/boston/radFiles/GlassBSDF_70_mat.mat ~/simulation/boston/radFiles/GlassFacade_74_mat.mat ~/simulation/boston/radFiles/GlassInt_74_mat.mat ~/simulation/boston/radFiles/GlassTak_70.rad ~/simulation/boston/radFiles/GlassInt_74.rad ~/simulation/boston/radFiles/GlassFacade_74.rad ~/simulation/boston/radFiles/GlassBSDF_70.rad ~/simulation/boston/radFiles/opaque_materials.mat ~/simulation/boston/radFiles/SkylightWall_70.rad ~/simulation/boston/radFiles/SlabCeiling_80.rad ~/simulation/boston/radFiles/SlabFloor_30.rad ~/simulation/boston/radFiles/SlabWall_50.rad ~/simulation/boston/radFiles/SlabJ_50.rad ~/simulation/boston/radFiles/WallExterior_50.rad ~/simulation/boston/radFiles/Roofs_50.rad ~/simulation/boston/radFiles/Doors_50.rad ~/simulation/boston/radFiles/FramesCW_50.rad ~/simulation/boston/radFiles/FacadeBright_70.rad ~/simulation/boston/radFiles/ContextBright_70.rad ~/simulation/boston/radFiles/WallInterior_70.rad ~/simulation/boston/radFiles/FacadeDark_30.rad ~/simulation/boston/radFiles/Frames_50.rad > ~/simulation/boston/octrees/my_test_scene_NOSKY.oct
echo ~/simulation/boston/octrees/my_test_scene_NOSKY.oct""",
    fireLogs=False,
    lastRunTime=1446,
    suppressWarnings=False)  # -> Stdout, Stderr_, Ran
hours_3 = Text(hours_2)
overrides_15 = ApplyOverrides(
    Input_=panel_43,
    OldOct=graft(executessh_wip_8.Stdout),
    NewRads=graft(sky_sunny),
    Target=graft("my_test_scene"),
    H=graft(hours_3))  # -> Output, Pairs
convertpaths_5 = ConvertPaths(I=executessh_wip_8.Stdout)  # -> Linux, Windows
panel_44 = Panel(executessh_wip_8.Stdout)
panel_45 = Panel(convertpaths_5.Windows)
panel_46 = Panel(executessh_wip_8.Stderr_)
executessh_3 = ExecuteSSH(
    _SSHCommands_=overrides_15.Output,
    Run=executessh_wip_8.Ran,
    addPrefix=True,
    description="""oconv -r 2048 -i <oldOct> -f <newRads> > ~/simulation/boston/octrees/my_test_scene_0800.oct;echo ~/simulation/boston/octrees/my_test_scene_0800.oct


- - -

oconv -r 2048 -i <oldOct> -f <newRads> > ~/simulation/boston/octrees/my_test_scene_0900.oct;echo ~/simulation/boston/octrees/my_test_scene_0900.oct


- - -

oconv -r 2048 -i <oldOct> -f <newRads> > ~/simulation/boston/octrees/my_test_scene_1000.oct;echo ~/simulation/boston/octrees/my_test_scene_1000.oct


- - -

oconv -r 2048 -i <oldOct> -f <newRads> > ~/simulation/boston/octrees/my_test_scene_1100.oct;echo ~/simulation/boston/octrees/my_test_scene_1100.oct


- - -

oconv -r 2048 -i <oldOct> -f <newRads> > ~/simulation/boston/octrees/my_test_scene_1200.oct;echo ~/simulation/boston/octrees/my_test_scene_1200.oct


- - -

oconv -r 2048 -i <oldOct> -f <newRads> > ~/simulation/boston/octrees/my_test_scene_1300.oct;echo ~/simulation/boston/octrees/my_test_scene_1300.oct


- - -

oconv -r 2048 -i <oldOct> -f <newRads> > ~/simulation/boston/octrees/my_test_scene_1400.oct;echo ~/simulation/boston/octrees/my_test_scene_1400.oct


- - -

oconv -r 2048 -i <oldOct> -f <newRads> > ~/simulation/boston/octrees/my_test_scene_1500.oct;echo ~/simulation/boston/octrees/my_test_scene_1500.oct


- - -

oconv -r 2048 -i <oldOct> -f <newRads> > ~/simulation/boston/octrees/my_test_scene_1600.oct;echo ~/simulation/boston/octrees/my_test_scene_1600.oct


- - -

oconv -r 2048 -i <oldOct> -f <newRads> > ~/simulation/boston/octrees/my_test_scene_1700.oct;echo ~/simulation/boston/octrees/my_test_scene_1700.oct""",
    fireLogs=False,
    lastRunTime=13671,
    suppressWarnings=False)  # -> Stdout, Stderr_, Ran

panel_47 = Panel(executessh_3.Stdout)

overrides_16 = ApplyOverrides(Input="head <target>", Target=graft(item.Item1))  # -> Output, Pairs

executessh_wip_9 = ExecuteSSHWIP(
    _SSHCommands_=overrides_16.Output,
    Run=executessh_wip_7.Ran,
    addPrefix=True,
    description="""head <target>


- - -

head <target>


- - -

head <target>


- - -

head <target>


- - -

head <target>


- - -

head <target>


- - -

head <target>


- - -

head <target>


- - -

head <target>


- - -

head <target>""",
    fireLogs=False,
    lastRunTime=133,
    suppressWarnings=False)  # -> Stdout, Stderr_, Ran

panel_48 = Panel(executessh_wip_9.Stdout)

# ----
# VIEW
panel_49 = Panel("""mkdir -p <proj>/views/
echo "<vf>" > <proj>/views/<target>.vf
echo <proj>/views/<target>.vf""")
panel_50 = Panel("""vf
target""")
vf = Text(view.ViewfileContent)
overrides_17 = ApplyOverrides(Input=panel_49, Vf=graft(vf), Target=graft("Perspective"))  # -> Output, Pairs
file_exists = Panel("[ -f <out> ] && echo \"1\" || echo \"0\"")

executessh_wip_10 = ExecuteSSHWIP(
    _SSHCommands_=overrides_17.Output,
    Run=button,
    addPrefix=True,
    description="""mkdir -p ~/simulation/boston/views/
echo "rvu -vtv -vp 46.8742121722379 185.155593694871 115.494748808975 -vd 0.854102293121218 -0.518876784048412 0.035723323762702 -vu -0.0305308600308033 0.0185478420964362 0.999361718367952 -vh 87.983 -vv 60.000" > ~/simulation/boston/views/Perspective.vf
echo ~/simulation/boston/views/Perspective.vf""",
    fireLogs=False,
    lastRunTime=25,
    suppressWarnings=False)  # -> Stdout, Stderr_, Ran

item_2 = ListItem(List=flatten(executessh_wip_10.Stdout), Index=0, Wrap=True)
panel_51 = Panel(executessh_wip_10.Stdout)
overrides_18 = ApplyOverrides(Input=file_exists, Out=graft(item_2))  # -> Output, Pairs

executessh_wip_11 = ExecuteSSHWIP(
    SSHCommands=overrides_18.Output,
    Run=executessh_2.Ran,
    addPrefix=False,
    description="[ -f <out> ] && echo \"1\" || echo \"0\"",
    fireLogs=False,
    lastRunTime=12,
    suppressWarnings=True)  # -> Stdout, Stderr, Ran

# ----
# Parallel RTRACE render
# this hdr is over exposed,
# I wonder what we can do with that..
run = LBFalseStartToggle(False)
octree = Text(executessh_2.Stdout)
viewfile = Text(executessh_wip_10.Stdout)
panel_52 = Panel("""mkdir -p <proj>/images/
vwrays -ff -x <x> -y <y> -vf <vf> -pa 1 | rtrace <radOptions> -n 11 `vwrays -d -ff -x <x> -y <y> -vf <vf> -pa 1` -ffc <oct> > <proj>/images/<target-.>.hdr
echo <proj>/images/<target-.>.hdr""")
panel_53 = Panel("-as 0 -ab 3 -aa 0 -ad 128")
panel_54 = Panel("echo \"rvu -vtv -vp 0.5 4.5 1.6 -vd 0.830824 -1.13002 -0.181063 -vu 0 0 1 -vh 98.2132 -vv 79.2785 -vo 0 -va 0 -vs 0 -vl 0\" > <proj>/views/myview.vf;echo <proj>/views/myview.vf")
overrides_19 = ApplyOverrides(
    Input=panel_52,
    RadOptions=graft(panel_53),
    X=graft("1700"),
    Y=graft("1000"),
    Vf=graft(viewfile),
    Oct=graft(octree),
    Target=graft("rtrace_rendering.png"))  # -> Output, Pairs
execute_ssh_async_5 = ExecuteSSHAsync(
    _SSHCommands_=panel_54,
    Run=run,
    addPrefix=True,
    addSuffix=True,
    fireLogs=False,
    stdouts="/home/mss/simulation/test_project2/views/myview.vf",
    suppressWarnings=False)  # -> Stdout, Stderr_, Log, port, Ran
execute_ssh_async_6 = ExecuteSSHAsync(
    _SSHCommands=overrides_19.Output,
    Run=run,
    addPrefix=True,
    addSuffix=False,
    description="""mkdir -p ~/simulation/boston/images/
vwrays -ff -x 1700 -y 1000 -vf /home/mss/simulation/boston/views/Perspective.vf -pa 1 | rtrace -as 0 -ab 3 -aa 0 -ad 128 -n 11 `vwrays -d -ff -x 1700 -y 1000 -vf /home/mss/simulation/boston/views/Perspective.vf -pa 1` -ffc /home/mss/simulation/boston/octrees/my_test_scene.oct > ~/simulation/boston/images/rtrace_rendering.hdr
echo ~/simulation/boston/images/rtrace_rendering.hdr""",
    fireLogs=False,
    name="Test",
    stdouts="/home/mss/simulation/boston/images/rtrace_rendering.hdr",
    suppressWarnings=False)  # -> Stdout, Stderr_, Log, port, Ran; disabled
panel_55 = Panel(execute_ssh_async_6.Stdout)  # disabled
convertpaths_6 = ConvertPaths(I=execute_ssh_async_6.Stdout)  # -> Linux, Windows; disabled
imageviewer_2 = LBImageViewer(ImagePath_=convertpaths_6.Windows, _scale_=2, DisableClickable=False, SaveImgWithCoords=False, scale=2)  # -> ImagePath, Values, GIF; disabled

# ----
# Parallel RTRACE render (illuminance)
# this hdr is over exposed,
# I wonder what we can do with that..
run_2 = LBFalseStartToggle(False)
panel_56 = Panel("""mkdir -p <proj>/images/
vwrays -ff -x <x> -y <y> -vf <vf> -pa 1 | rtrace -I <radOptions> -n <cpus> `vwrays -d -ff -x <x> -y <y> -vf <vf> -pa 1` -ffc <oct> > <proj>/images/<target-.>.hdr
echo <proj>/images/<target-.>.hdr""")
octree_2 = Text(executessh_2.Stdout)
viewfile_2 = Text(executessh_wip_10.Stdout)
panel_57 = Panel("-i -ab 1 -ad 512")
panel_58 = Panel("echo \"rvu -vtv -vp 0.5 4.5 1.6 -vd 0.830824 -1.13002 -0.181063 -vu 0 0 1 -vh 98.2132 -vv 79.2785 -vo 0 -va 0 -vs 0 -vl 0\" > <proj>/views/myview.vf;echo <proj>/views/myview.vf")
panel_59 = Panel("500")
panel_60 = Panel("600")
overrides_20 = ApplyOverrides(
    Input=panel_56,
    RadOptions=graft(panel_53),
    X=graft("1700"),
    Y=graft("1000"),
    Vf=graft(viewfile_2),
    Oct=graft(octree_2),
    Target=graft("rtrace_rendering_illum.png"))  # -> Output, Pairs
execute_ssh_async_7 = ExecuteSSHAsync(
    _SSHCommands_=panel_58,
    Run=run_2,
    addPrefix=True,
    addSuffix=True,
    fireLogs=False,
    stdouts="/home/mss/simulation/test_project2/views/myview.vf",
    suppressWarnings=False)  # -> Stdout, Stderr_, Log, port, Ran
execute_ssh_async_8 = ExecuteSSHAsync(
    _SSHCommands=overrides_20.Output,
    Run=run_2,
    addPrefix=True,
    addSuffix=False,
    fireLogs=False,
    stdouts="/home/mss/simulation/test_project2/images/rtrace_rendering_illum.hdr",
    suppressWarnings=False)  # -> Stdout, Stderr_, Log, port, Ran; disabled
panel_61 = Panel(execute_ssh_async_8.Stdout)  # disabled
convertpaths_7 = ConvertPaths(I=execute_ssh_async_8.Stdout)  # -> Linux, Windows; disabled
imageviewer_3 = LBImageViewer(ImagePath_=convertpaths_7.Windows, _scale_=1, DisableClickable=False, SaveImgWithCoords=False, scale=1)  # -> ImagePath, Values, GIF; disabled

# ----
# RENDER TESTS
# rpict RENDER
# single core render, using normtiff to set
# exposure and convert to png
# -ps 8 -pt 0.15 -pj 0.6 -dj 0 -ds 0.5 -dt 0.5 -dc 0.25 -dr 0 -dp 64 -st 0.85 -ab 2 -ad 512 -as 128 -ar 16 -aa 0.250 -lr 4 -lw 0.050 -av 0 0 0
panel_62 = Panel("""mkdir -p <proj>/images/
rpict -t 10 -vf <vf> -x <x> -y <y> <radPar> <octree> > <proj>/images/<target-.>_<vn>.hdr
normtiff <proj>/images/<target-.>_<vn>.hdr <proj>/images/<target-.>_<vn>.tif
convert <proj>/images/<target-.>_<vn>.tif <proj>/images/<target-.>_<vn>.png
echo <proj>/images/<target-.>_<vn>.png""")  # disabled
viewfiles = Text(executessh_wip_10.Stdout)  # disabled
panel_63 = Panel("rpict_render")  # disabled
octree_3 = Text(executessh_2.Stdout)  # disabled
python_11 = GhPythonScript(viewfile=viewfiles)  # -> viewname; disabled
# ---------- python_11: Python ----------
__author__ = "mm1013"
__version__ = "2022.07.09"

import rhinoscriptsyntax as rs

viewname = viewfile.split("/")[-1].split(".")[0]
# ---------- end python_11 ----------
falsestart_6 = LBFalseStartToggle(False)  # disabled
panel_64 = Panel("-ab 1 -ad 2048 -ar 128 -as 512 -aa 0.12 -lw 5e-2")  # disabled
panel_65 = Panel("600")  # disabled
panel_66 = Panel("500")  # disabled
and_3 = GateAnd(A=executessh_2.Ran, B=executessh_wip_11.Stdout, C=falsestart_6)  # disabled
overrides_21 = ApplyOverrides(
    Input=panel_62,
    Vf=graft(viewfiles),
    X=graft(panel_65),
    Y=graft(panel_66),
    RadPar=graft(panel_64),
    Octree=graft(octree_3),
    Target=graft(panel_63),
    Vn=graft(python_11))  # -> Output, Pairs; disabled
execute_ssh_async_9 = ExecuteSSHAsync(
    _SSHCommands_=overrides_21.Output,
    Run=falsestart_6,
    addPrefix=True,
    addSuffix=True,
    description="""mkdir -p ~/simulation/boston/images/
rpict -t 10 -vf /home/mss/simulation/boston/views/Perspective.vf -x 600 -y 500 -ab 1 -ad 2048 -ar 128 -as 512 -aa 0.12 -lw 5e-2 /home/mss/simulation/boston/octrees/my_test_scene.oct > ~/simulation/boston/images/_Perspective.hdr
normtiff ~/simulation/boston/images/_Perspective.hdr ~/simulation/boston/images/_Perspective.tif
convert ~/simulation/boston/images/_Perspective.tif ~/simulation/boston/images/_Perspective.png
echo ~/simulation/boston/images/_Perspective.png""",
    fireLogs=False,
    stdouts="/home/mss/simulation/boston/images/_Perspective.png",
    suppressWarnings=False)  # -> Stdout, Stderr_, port, port_2, Ran; disabled
convertpaths_8 = ConvertPaths(I=execute_ssh_async_9.Stdout)  # -> Linux, Windows; disabled
imageviewer_4 = LBImageViewer(ImagePath_=convertpaths_8.Windows, _scale_=1, DisableClickable=False, SaveImgWithCoords=False, scale=1)  # -> ImagePath, Values, GIF; disabled

# ----
# Parallel RTPICT render (luminance)
viewfile_3 = Text(executessh_wip_10.Stdout)
octree_4 = Text(executessh_3.Stdout)
panel_67 = Panel("""mkdir -p <proj>/images/
rtpict -n 11 -vf <vf> -x <x> -y <y> -o <proj>/images/<target> <radOptions> <oct>;echo <proj>/images/<target>""")
resolution_3 = ValueList({"750x330": 750, "1500x750": 1500, "3000x1500": 3000, "5000x2500": 5000, "7000x3500": 7000, "8000x4000": 8000}, selected="1500x750")
division = Division(A=resolution_3, B=2)
run_3 = LBFalseStartToggle(False)
python_12 = GhPythonScript(update=run_3)  # -> time; inputs update: tree
# ---------- python_12: Python ----------
__author__ = "mm1013"
__version__ = "2022.08.30"

import rhinoscriptsyntax as rs

from datetime import datetime
dt = datetime.now()

time = "%02d_%02d_%02d_%02d%02d" % (dt.year, dt.month, dt.day, dt.hour, dt.minute)
# ---------- end python_12 ----------
hours_4 = Number(hours)
overrides_22 = ApplyOverrides(
    Input=panel_67,
    RadOptions=graft("-ab 3 -ad 32 -aa 0"),
    X=graft(resolution_3),
    Y=graft(division),
    Vf=graft(viewfile_3),
    Oct=graft(octree_4),
    Target=graft("<time>_rtpict_rendering_aa0_<x>_sunny_ad32_<h>.hdr"),
    Time=graft(python_12),
    H=graft(hours_4))  # -> Output, Pairs
executessh_4 = ExecuteSSH(
    _SSHCommands_=flatten(overrides_22.Output),
    Run=run_3,
    addPrefix=True,
    description="""mkdir -p ~/simulation/boston/images/
rtpict -n 11 -vf <vf> -x 1500 -y 750 -o ~/simulation/boston/images/2022_09_05_1050_rtpict_rendering_aa0_1500_sunny_ad32_800.hdr -ab 3 -ad 32 -aa 0 <oct>;echo ~/simulation/boston/images/2022_09_05_1050_rtpict_rendering_aa0_1500_sunny_ad32_800.hdr
mkdir -p ~/simulation/boston/images/
rtpict -n 11 -vf <vf> -x 1500 -y 750 -o ~/simulation/boston/images/2022_09_05_1050_rtpict_rendering_aa0_1500_sunny_ad32_900.hdr -ab 3 -ad 32 -aa 0 <oct>;echo ~/simulation/boston/images/2022_09_05_1050_rtpict_rendering_aa0_1500_sunny_ad32_900.hdr
mkdir -p ~/simulation/boston/images/
rtpict -n 11 -vf <vf> -x 1500 -y 750 -o ~/simulation/boston/images/2022_09_05_1050_rtpict_rendering_aa0_1500_sunny_ad32_1000.hdr -ab 3 -ad 32 -aa 0 <oct>;echo ~/simulation/boston/images/2022_09_05_1050_rtpict_rendering_aa0_1500_sunny_ad32_1000.hdr
mkdir -p ~/simulation/boston/images/
rtpict -n 11 -vf <vf> -x 1500 -y 750 -o ~/simulation/boston/images/2022_09_05_1050_rtpict_rendering_aa0_1500_sunny_ad32_1100.hdr -ab 3 -ad 32 -aa 0 <oct>;echo ~/simulation/boston/images/2022_09_05_1050_rtpict_rendering_aa0_1500_sunny_ad32_1100.hdr
mkdir -p ~/simulation/boston/images/
rtpict -n 11 -vf <vf> -x 1500 -y 750 -o ~/simulation/boston/images/2022_09_05_1050_rtpict_rendering_aa0_1500_sunny_ad32_1200.hdr -ab 3 -ad 32 -aa 0 <oct>;echo ~/simulation/boston/images/2022_09_05_1050_rtpict_rendering_aa0_1500_sunny_ad32_1200.hdr
mkdir -p ~/simulation/boston/images/
rtpict -n 11 -vf <vf> -x 1500 -y 750 -o ~/simulation/boston/images/2022_09_05_1050_rtpict_rendering_aa0_1500_sunny_ad32_1300.hdr -ab 3 -ad 32 -aa 0 <oct>;echo ~/simulation/boston/images/2022_09_05_1050_rtpict_rendering_aa0_1500_sunny_ad32_1300.hdr
mkdir -p ~/simulation/boston/images/
rtpict -n 11 -vf <vf> -x 1500 -y 750 -o ~/simulation/boston/images/2022_09_05_1050_rtpict_rendering_aa0_1500_sunny_ad32_1400.hdr -ab 3 -ad 32 -aa 0 <oct>;echo ~/simulation/boston/images/2022_09_05_1050_rtpict_rendering_aa0_1500_sunny_ad32_1400.hdr
mkdir -p ~/simulation/boston/images/
rtpict -n 11 -vf <vf> -x 1500 -y 750 -o ~/simulation/boston/images/2022_09_05_1050_rtpict_rendering_aa0_1500_sunny_ad32_1500.hdr -ab 3 -ad 32 -aa 0 <oct>;echo ~/simulation/boston/images/2022_09_05_1050_rtpict_rendering_aa0_1500_sunny_ad32_1500.hdr
mkdir -p ~/simulation/boston/images/
rtpict -n 11 -vf <vf> -x 1500 -y 750 -o ~/simulation/boston/images/2022_09_05_1050_rtpict_rendering_aa0_1500_sunny_ad32_1600.hdr -ab 3 -ad 32 -aa 0 <oct>;echo ~/simulation/boston/images/2022_09_05_1050_rtpict_rendering_aa0_1500_sunny_ad32_1600.hdr
mkdir -p ~/simulation/boston/images/
rtpict -n 11 -vf <vf> -x 1500 -y 750 -o ~/simulation/boston/images/2022_09_05_1050_rtpict_rendering_aa0_1500_sunny_ad32_1700.hdr -ab 3 -ad 32 -aa 0 <oct>;echo ~/simulation/boston/images/2022_09_05_1050_rtpict_rendering_aa0_1500_sunny_ad32_1700.hdr""",
    fireLogs=True,
    lastRunTime=1329254,
    name="rtpict",
    suppressWarnings=False)  # -> Stdout, Stderr_, Ran

# ----
# Using PCOND to set automatic exposure
# and convert to PNG
panel_68 = Panel("""pcond -h <hdr> <hdr-.>_exposed.hdr
ra_tiff <hdr-.>_exposed.hdr <hdr-.>_exposed.tif
convert <hdr-.>_exposed.tif <hdr-.>_exposed.png
echo <hdr-.>_exposed.png""")  # disabled
overrides_23 = ApplyOverrides(Input_=panel_68, Hdr=graft(execute_ssh_async_6.Stdout))  # -> Output, Pairs; disabled
execute_ssh_async_10 = ExecuteSSHAsync(
    _SSHCommands_=overrides_23.Output,
    Run=False,
    addPrefix=True,
    addSuffix=True,
    description="""pcond -h /home/mss/simulation/boston/images/rtrace_rendering.hdr /home/mss/simulation/boston/images/rtrace_rendering_exposed.hdr
ra_tiff /home/mss/simulation/boston/images/rtrace_rendering_exposed.hdr /home/mss/simulation/boston/images/rtrace_rendering_exposed.tif
convert /home/mss/simulation/boston/images/rtrace_rendering_exposed.tif /home/mss/simulation/boston/images/rtrace_rendering_exposed.png
echo /home/mss/simulation/boston/images/rtrace_rendering_exposed.png""",
    fireLogs=False,
    stdouts="/home/mss/simulation/boston/images/rtrace_rendering_exposed.png",
    suppressWarnings=False)  # -> Stdout, Stderr_, Log, port, Ran; disabled
panel_69 = Panel("1.5")  # disabled
convertpaths_9 = ConvertPaths(I=execute_ssh_async_10.Stdout)  # -> Linux, Windows; disabled
imageviewer_5 = LBImageViewer(ImagePath_=convertpaths_9.Windows, _scale_=panel_69, DisableClickable=False, SaveImgWithCoords=False, scale=1.5)  # -> ImagePath, Values, GIF; disabled

# ----
# False color with illuminance curves
# on top of luminance picture
panel_70 = Panel("falsecolor -s 9000 -l lux -p <rad-.>_exposed.hdr -i <irrad> -cl -log 2 > <rad-.>_fc.hdr;echo <rad-.>_fc.hdr")  # disabled
and_4 = GateAnd()  # disabled
overrides_24 = ApplyOverrides(Input_=panel_70, Rad=graft(execute_ssh_async_6.Stdout), Irrad=graft(execute_ssh_async_8.Stdout))  # -> Output, Pairs; disabled
execute_ssh_async_11 = ExecuteSSHAsync(
    _SSHCommands_=overrides_24.Output,
    Run=and_4,
    addPrefix=True,
    addSuffix=True,
    fireLogs=False,
    stdouts="/home/mss/simulation/test_project2/images/rtrace_rendering_fc.hdr",
    suppressWarnings=False)  # -> Stdout, Stderr_, Log, port, Ran; disabled
convertpaths_10 = ConvertPaths(I=execute_ssh_async_11.Stdout)  # -> Linux, Windows; disabled
panel_71 = Panel("1.5")  # disabled
imageviewer_6 = LBImageViewer(ImagePath_=convertpaths_10.Windows, _scale_=panel_71, DisableClickable=False, SaveImgWithCoords=False, scale=1.5)  # -> ImagePath, Values, GIF; disabled

# ----
# Using PCOND to set automatic exposure
# and convert to PNG
panel_72 = Panel("""pcond -h <hdr> <hdr-.>_exposed.hdr
ra_tiff <hdr-.>_exposed.hdr <hdr-.>_exposed.tif
convert <hdr-.>_exposed.tif <hdr-.>_exposed.png
echo <hdr-.>_exposed.png""")  # disabled
overrides_25 = ApplyOverrides(Input_=panel_72, Hdr=graft(execute_ssh_async_8.Stdout))  # -> Output, Pairs; disabled
execute_ssh_async_12 = ExecuteSSHAsync(
    _SSHCommands_=overrides_25.Output,
    Run=False,
    addPrefix=True,
    addSuffix=True,
    fireLogs=False,
    stdouts="/home/mss/simulation/test_project2/images/rtrace_rendering_illum_exposed.png",
    suppressWarnings=False)  # -> Stdout, Stderr_, Log, port, Ran; disabled
convertpaths_11 = ConvertPaths(I=execute_ssh_async_12.Stdout)  # -> Linux, Windows; disabled
panel_73 = Panel("1.5")  # disabled
imageviewer_7 = LBImageViewer(ImagePath_=convertpaths_11.Windows, _scale_=panel_73, DisableClickable=False, SaveImgWithCoords=False, scale=1.5)  # -> ImagePath, Values, GIF; disabled

# ----
# Using pfilt to downscale image
# radius per Mark Stock:
# http://markjstock.org/radmisc/aa0_test/final.html
panel_74 = Panel("pfilt -x /2 -y /2 -1 -r 0.7 <file> > <file-.>_filtered.hdr;echo <file-.>_filtered.hdr")
overrides_26 = ApplyOverrides(Input_=panel_74, File=graft(executessh_4.Stdout))  # -> Output, Pairs
executessh_5 = ExecuteSSH(
    _SSHCommands_=flatten(overrides_26.Output),
    Run=executessh_4.Ran,
    addPrefix=True,
    description="pfilt -x /2 -y /2 -1 -r 0.7 <file> > <file>_filtered.hdr;echo <file>_filtered.hdr",
    fireLogs=False,
    lastRunTime=2226,
    suppressWarnings=False)  # -> Stdout, Stderr_, Ran

panel_75 = Panel(convertpaths_9.Windows)  # disabled

# ----
# Parallel RTPICT render with ambient cache
viewfile_4 = Text(executessh_wip_10.Stdout)
octree_5 = Text(executessh_3.Stdout)
octree_overcast_2 = Text(octree_overcast)
entwine_6 = Entwine(Branch00=octree_overcast_2, Branch01=octree_5, FlattenInputs=True)  # -> flatten(Result)
division_2 = Division(A=resolution, B=1.5)
octree_6 = Text(graft(entwine_6))
list_2 = ItemSelector(octree_6)
eval = Evaluate(F="x=y", x=octree_6, y=list_2)
panel_76 = Panel("""mkdir -p <proj>/images/
rtpict -n 30 -w -vf <vf> -x <x> -y <y> <radOptions> <oct> > <proj>/images/<target>;echo <proj>/images/<target>""")
x_3 = Number(x)
run_4 = LBFalseStartToggle(False)

y = Number(division_2)

hours_5 = Text(hours_2)
entwine_7 = Entwine(Branch00="ovc", Branch01=hours_5, FlattenInputs=True)  # -> flatten(Result)
cull_7 = CullPattern(List=graft(entwine_7), CullPattern=eval)  # -> flatten(List)
hours_6 = Text(cull_7)

# ----
# Parallel RTPICT render (luminance)
viewfile_5 = Text(executessh_wip_10.Stdout)
octree_7 = Text(executessh_3.Stdout)
octree_overcast_3 = Text(octree_overcast)
entwine_8 = Entwine(Branch00=octree_overcast_3, Branch01=octree_7, FlattenInputs=True)  # -> flatten(Result)
division_3 = Division(A=resolution_2, B=1.5)
octree_8 = Text(graft(entwine_8))
list_3 = ItemSelector(octree_8)
eval_2 = Evaluate(F="x=y", x=octree_8, y=list_3)
panel_77 = Panel("""mkdir -p <proj>/images/
rtpict -n 30 -w -vf <vf> -x <x> -y <y> <radOptions> <oct> | pfilt -x /4 -y /4 -r 0.7 > <proj>/images/<target>;echo <proj>/images/<target>""")
x_4 = Number(x_2)
run_5 = LBFalseStartToggle(False)

y_2 = Number(division_3)

hours_7 = Text(hours_2)
entwine_9 = Entwine(Branch00="ovc", Branch01=hours_7, FlattenInputs=True)  # -> flatten(Result)
cull_8 = CullPattern(List=graft(entwine_9), CullPattern=eval_2)  # -> flatten(List)
hours_8 = Text(cull_8)

# ----
# Parallel RTPICT render (Illuminance)
# (takes 2.5X longer than above...)
# mkdir -p <proj>/images/
# rtpict -i -w -n 30 -vf <vf> -x <x> -y <y> <radOptions> <oct> | pfilt -x /4 -y /4 -r 0.7 > <proj>/images/<target>;echo <proj>/images/<target>
panel_78 = Panel("""mkdir -p <proj>/images/
rtpict -i -w -n 62 -vf <vf> -x <x> -y <y> <radOptions> <oct> | pfilt -x /4 -y /4 -r 0.7 > <proj>/images/<target>;echo <proj>/images/<target>""")
run_6 = LBFalseStartToggle(False)
y_3 = Number(y_2)
x_5 = Number(x_2)

y_4 = Number(y)
overrides_27 = ApplyOverrides(
    Input=panel_76,
    RadOptions=graft("-ab 3 -ad 256 -lw 0.004 -aa 0.1 -ar 128 -as 256"),
    X=graft(x_3),
    Y=graft(y_4),
    Vf=graft(viewfile_4),
    Oct=graft(list_2),
    Target=graft("<time>_rtpict_rendering_aa0.1_<x>_sunny_ad16_<h>.hdr"),
    Time=graft("<time>"),
    H=graft(hours_6))  # -> Output, Pairs

python_13 = GhPythonScript(update=overrides_27.Pairs)  # -> time; inputs update: list
# ---------- python_13: Python ----------
from ghpythonlib.componentbase import executingcomponent as component
import Grasshopper, GhPython
import System
import Rhino
import rhinoscriptsyntax as rs

class MyComponent(component):
    
    
    time = ""
    
    def RunScript(self, update):
        #if not update:
        #    return self.time
        """Provides a scripting component.
            Inputs:
                x: The x script variable
                y: The y script variable
            Output:
                a: The a output variable"""
        
        __author__ = "mm1013"
        __version__ = "2022.08.30"
        
        import rhinoscriptsyntax as rs
        
        from datetime import datetime
        dt = datetime.now()
        
        self.time = "%02d_%02d_%02d_%02d%02d_%02d" % (dt.year, dt.month, dt.day, dt.hour, dt.minute, dt.second)
        
        # return outputs if you have them; here I try it for you:
        return self.time
# ---------- end python_13 ----------
overrides_28 = ApplyOverrides(Input_=overrides_27.Output, Time=graft(python_13))  # -> Output, Pairs

executessh_6 = ExecuteSSH(
    _SSHCommands_=flatten(overrides_28.Output),
    Run=run_4,
    addPrefix=True,
    description="""mkdir -p ~/simulation/boston/images/
rtpict -n 30 -w -vf <vf> -x 750 -y 500 -ab 3 -ad 256 -lw 0.004 -aa 0.1 -ar 128 -as 256 <oct> > ~/simulation/boston/images/<time>_rtpict_rendering_aa0.1_750_sunny_ad16_<h>.hdr;echo ~/simulation/boston/images/<time>_rtpict_rendering_aa0.1_750_sunny_ad16_<h>.hdr""",
    fireLogs=True,
    lastRunTime=2886515,
    name="rtpict",
    suppressWarnings=False)  # -> Stdout, Stderr_, Ran

panel_79 = Panel(executessh_6.Stdout)

y_5 = Number(y_2)
overrides_29 = ApplyOverrides(
    Input=panel_77,
    RadOptions=graft("-ab 3 -ad 16 -aa 0"),
    X=graft(x_4),
    Y=graft(y_5),
    Vf=graft(viewfile_5),
    Oct=graft(list_3),
    Target=graft("<time>_rtpict_rendering_aa0_<x>_sunny_ad16_<h>.hdr"),
    Time=graft("<time>"),
    H=graft(hours_8))  # -> Output, Pairs

python_14 = GhPythonScript(update=overrides_29.Pairs)  # -> time; inputs update: list; same code as python_13

overrides_30 = ApplyOverrides(
    Input=panel_78,
    RadOptions=graft("-ab 3 -ad 16 -aa 0"),
    X=graft(x_5),
    Y=graft(y_3),
    Vf=graft(viewfile_5),
    Oct=graft(list_3),
    Target=graft("<time>_rtpict_rendering_aa0_<x>_sunny_ad8_<h>_illum.hdr"),
    Time=graft(python_14),
    H=graft(hours_8))  # -> Output, Pairs
executessh_7 = ExecuteSSH(
    _SSHCommands_=flatten(overrides_30.Output),
    Run=run_6,
    addPrefix=True,
    description="""mkdir -p ~/simulation/boston/images/
rtpict -i -w -n 62 -vf <vf> -x 7000 -y 4666.666667 -ab 3 -ad 16 -aa 0 <oct> | pfilt -x /4 -y /4 -r 0.7 > ~/simulation/boston/images/<time>_rtpict_rendering_aa0_7000_sunny_ad8_<h>_illum.hdr;echo ~/simulation/boston/images/<time>_rtpict_rendering_aa0_7000_sunny_ad8_<h>_illum.hdr""",
    fireLogs=True,
    lastRunTime=423914,
    name="rtpict",
    suppressWarnings=False)  # -> Stdout, Stderr_, Ran

overrides_31 = ApplyOverrides(Input_=overrides_29.Output, Time=graft(python_14))  # -> Output, Pairs

executessh_8 = ExecuteSSH(
    _SSHCommands_=flatten(overrides_31.Output),
    Run=run_5,
    addPrefix=True,
    description="""mkdir -p ~/simulation/boston/images/
rtpict -n 30 -w -vf <vf> -x 7000 -y 4666.666667 -ab 3 -ad 16 -aa 0 <oct> | pfilt -x /4 -y /4 -r 0.7 > ~/simulation/boston/images/<time>_rtpict_rendering_aa0_7000_sunny_ad16_<h>.hdr;echo ~/simulation/boston/images/<time>_rtpict_rendering_aa0_7000_sunny_ad16_<h>.hdr""",
    fireLogs=True,
    lastRunTime=2886515,
    name="rtpict",
    suppressWarnings=False)  # -> Stdout, Stderr_, Ran

# ----
# orig dimensions
panel_80 = Panel("getinfo <f>")
overrides_32 = ApplyOverrides(Input_=panel_80, F=graft(executessh_7.Stdout))  # -> Output, Pairs
executessh_wip_12 = ExecuteSSHWIP(
    _SSHCommands_=overrides_32.Output,
    Run=executessh_7.Ran,
    addPrefix=True,
    description="getinfo <f>",
    fireLogs=False,
    lastRunTime=76,
    suppressWarnings=False)  # -> Stdout, Stderr_, Ran
x_6 = Number(x_2)
division_4 = Division(A=x_6, B=4)
python_15 = GhPythonScript(x=executessh_wip_12.Stdout)  # -> out, org_y
# ---------- python_15: Python ----------
__author__ = "mm1013"
__version__ = "2022.08.31"

import rhinoscriptsyntax as rs

lines = x.replace("\r","").split("\n")

for l in lines:
    line = l.strip()
    if line.startswith("rtrace"):
        print "RTRACE"
        li = line.split("-y")
        
        print li[1].strip().split(" ")[0]
        org_y = int(li[1].strip().split(" ")[0])
    elif line.startswith("pfilt"):
        print "PFIlT"
        li = line.split("-y")
        
        print li[1].strip().split(" ")[0]
        org_y = org_y / float(li[1].strip().split(" ")[0].replace("/",""))
# ---------- end python_15 ----------

# ----
# blurring the irrad
panel_81 = Panel("pfilt -x /3 -y /3 -r 1 <file> | pfilt -1 -x <x> -y <y> > <file-.>_filteredBlur.hdr;ra_tiff <file-.>_filteredBlur.hdr <file-.>_filteredBlur.tif;echo <file-.>_filteredBlur.hdr")
overrides_33 = ApplyOverrides(Input_=panel_81, File=graft(executessh_7.Stdout), X=graft(division_4), Y=graft(python_15.org_y))  # -> Output, Pairs
executessh_wip_13 = ExecuteSSHWIP(
    _SSHCommands_=overrides_33.Output,
    Run=executessh_7.Ran,
    addPrefix=True,
    description="pfilt -x /3 -y /3 -r 1 <file> | pfilt -1 -x 1750 -y <y> > <file>_filteredBlur.hdr;ra_tiff <file>_filteredBlur.hdr <file>_filteredBlur.tif;echo <file>_filteredBlur.hdr",
    fireLogs=False,
    lastRunTime=1104,
    suppressWarnings=False)  # -> Stdout, Stderr_, Ran

# ----
# FalseColor
panel_82 = Panel("""pfilt -x /2 -y /2 -r 0.7 <irrad> | falsecolor -s 2000 -l lux -lw 200 -lh 300 > <irrad-.>_fc2.hdr
ra_tiff <irrad-.>_fc2.hdr <irrad-.>_fc2.tif
convert <irrad-.>_fc2.tif <irrad-.>_fc2.png
rm <irrad-.>_fc2.hdr
rm <irrad-.>_fc2.tif
echo <irrad-.>_fc2.png""")
overrides_34 = ApplyOverrides(Input_=panel_82, Irrad=graft(executessh_7.Stdout))  # -> Output, Pairs
executessh_wip_14 = ExecuteSSHWIP(
    _SSHCommands_=overrides_34.Output,
    Run=executessh_7.Ran,
    addPrefix=True,
    description="""pfilt -x /2 -y /2 -r 0.7 <irrad> | falsecolor -s 2000 -l lux -lw 200 -lh 300 > <irrad>_fc2.hdr
ra_tiff <irrad>_fc2.hdr <irrad>_fc2.tif
convert <irrad>_fc2.tif <irrad>_fc2.png
rm <irrad>_fc2.hdr
rm <irrad>_fc2.tif
echo <irrad>_fc2.png""",
    fireLogs=False,
    lastRunTime=1368,
    suppressWarnings=False)  # -> Stdout, Stderr_, Ran
convertpaths_12 = ConvertPaths(I=executessh_wip_14.Stdout)  # -> Linux, flatten(Windows)

# ----
# save pngs exposed and raw
panel_83 = Panel("""ra_tiff <hdr-.>.hdr <hdr-.>.tif
convert <hdr-.>.tif <hdr-.>.png
rm <hdr-.>.tif
echo <hdr-.>.png""")
panel_84 = Panel("""pcond -h <hdr> <hdr-.>_exposed.hdr
ra_tiff <hdr-.>_exposed.hdr <hdr-.>_exposed.tif
convert <hdr-.>_exposed.tif <hdr-.>_exposed.png
rm <hdr-.>_exposed.tif
rm <hdr-.>_exposed.hdr
echo <hdr-.>_exposed.png""")
entwine_10 = Entwine(Branch00=panel_84, Branch01=panel_83, FlattenInputs=True)
overrides_35 = ApplyOverrides(Input_=entwine_10, Hdr=graft(executessh_7.Stdout))  # -> Output, Pairs
executessh_wip_15 = ExecuteSSHWIP(
    _SSHCommands_=overrides_35.Output,
    Run=executessh_7.Ran,
    addPrefix=True,
    description="""pcond -h <hdr> <hdr>_exposed.hdr
ra_tiff <hdr>_exposed.hdr <hdr>_exposed.tif
convert <hdr>_exposed.tif <hdr>_exposed.png
rm <hdr>_exposed.tif
rm <hdr>_exposed.hdr
echo <hdr>_exposed.png


- - -

ra_tiff <hdr>.hdr <hdr>.tif
convert <hdr>.tif <hdr>.png
rm <hdr>.tif
echo <hdr>.png""",
    fireLogs=False,
    lastRunTime=3436,
    suppressWarnings=False)  # -> Stdout, Stderr_, Ran
convertpaths_13 = ConvertPaths(I=executessh_wip_15.Stdout)  # -> Linux, flatten(Windows)
item_3 = ListItem(List=convertpaths_13.Windows, Index=0, Wrap=True)  # -> Item, Item1

panel_85 = Panel("""pcond -h <hdr> <hdr-.>_exposed.hdr
ra_tiff <hdr-.>_exposed.hdr <hdr-.>_exposed.tif
convert <hdr-.>_exposed.tif <hdr-.>_exposed.png
echo <hdr-.>_exposed.png""")
panel_86 = Panel("""ra_tiff <hdr-.>.hdr <hdr-.>.tif
convert <hdr-.>.tif <hdr-.>.png
echo <hdr-.>.png""")
entwine_11 = Entwine(Branch00=panel_85, Branch01=panel_86, FlattenInputs=True)
overrides_36 = ApplyOverrides(Input_=entwine_11, Hdr=graft(executessh_8.Stdout))  # -> Output, Pairs
executessh_wip_16 = ExecuteSSHWIP(
    _SSHCommands_=overrides_36.Output,
    Run=executessh_8.Ran,
    addPrefix=True,
    description="""pcond -h <hdr> <hdr>_exposed.hdr
ra_tiff <hdr>_exposed.hdr <hdr>_exposed.tif
convert <hdr>_exposed.tif <hdr>_exposed.png
echo <hdr>_exposed.png


- - -

ra_tiff <hdr>.hdr <hdr>.tif
convert <hdr>.tif <hdr>.png
echo <hdr>.png""",
    fireLogs=False,
    lastRunTime=35119,
    suppressWarnings=False)  # -> Stdout, Stderr_, Ran
convertpaths_14 = ConvertPaths(I=executessh_wip_16.Stdout)  # -> Linux, flatten(Windows)
item_4 = ListItem(List=convertpaths_14.Windows, Index=0, Wrap=True)  # -> Item, Item1

# ----
# overlay illuminance falsecolor on luminance picture
panel_87 = Panel("""pcond -h <rad> | pfilt -x /2 -y /2 -r 0.7 > <rad-.>exposed_sd.hdr
pfilt -x /2 -y /2 -r 0.7 <irrad> > <irrad-.>_sd.hdr
falsecolor -s 2000 -l lux -lw 200 -lh 300 -p <rad-.>exposed_sd.hdr -i <irrad-.>_sd.hdr -cl > <rad-.>_fc.hdr
ra_tiff <rad-.>_fc.hdr <rad-.>_fc.tif
convert <rad-.>_fc.tif <rad-.>_fc.png
echo <rad-.>_fc.hdr""")
panel_88 = Panel("-log 2")
overrides_37 = ApplyOverrides(Input_=panel_87, Rad=graft(executessh_8.Stdout), Irrad=graft(executessh_wip_13.Stdout))  # -> Output, Pairs
and_5 = GateAnd(A=executessh_8.Ran, B=executessh_7.Ran)
executessh_wip_17 = ExecuteSSHWIP(
    _SSHCommands_=overrides_37.Output,
    Run=and_5,
    addPrefix=True,
    description="""pcond -h <rad> | pfilt -x /2 -y /2 -r 0.7 > <rad>exposed_sd.hdr
pfilt -x /2 -y /2 -r 0.7 <irrad> > <irrad>_sd.hdr
falsecolor -s 2000 -l lux -lw 200 -lh 300 -p <rad>exposed_sd.hdr -i <irrad>_sd.hdr -cl > <rad>_fc.hdr
ra_tiff <rad>_fc.hdr <rad>_fc.tif
convert <rad>_fc.tif <rad>_fc.png
echo <rad>_fc.hdr""",
    fireLogs=False,
    lastRunTime=18,
    suppressWarnings=False)  # -> Stdout, Stderr_, Ran
convertpaths_15 = ConvertPaths(I=executessh_wip_17.Stdout)  # -> Linux, flatten(Windows)

imageviewer_8 = LBImageViewer(ImagePath_=convertpaths_12.Windows, _scale_=2, DisableClickable=False, SaveImgWithCoords=False, scale=2)  # -> ImagePath, Values, GIF
imageviewer_9 = LBImageViewer(ImagePath_=item_3.Item, _scale_=2, DisableClickable=False, SaveImgWithCoords=False, scale=2)  # -> ImagePath, Values, GIF
imageviewer_10 = LBImageViewer(ImagePath_=item_3.Item1, _scale_=2, DisableClickable=False, SaveImgWithCoords=False, scale=2)  # -> ImagePath, Values, GIF
imageviewer_11 = LBImageViewer(ImagePath_=convertpaths_15.Windows, _scale_=2, DisableClickable=False, SaveImgWithCoords=False, scale=2)  # -> ImagePath, Values, GIF
imageviewer_12 = LBImageViewer(ImagePath_=item_4.Item, _scale_=3, DisableClickable=False, SaveImgWithCoords=False, scale=3)  # -> ImagePath, Values, GIF

# ----
# Using PCOND to set automatic exposure
# and convert to PNG
# pcond -h <hdr> <hdr-.>_exposed.hdr
# ra_tiff <hdr-.>_exposed.hdr <hdr-.>_exposed.tif
# convert <hdr-.>_exposed.tif <hdr-.>_exposed.png
# echo <hdr-.>_exposed.png
# pcompos -a 15 -b 1 1 1 -s 5 <proj>/mtxs/skyRenders/skyTregenza*.hdr > <proj>/mtxs/skyRenders/all.hdr
panel_89 = Panel("pcond -h <hdr> <hdr-.>_exposed.hdr;echo <hdr-.>_exposed.hdr")
overrides_38 = ApplyOverrides(Input_=panel_89, Hdr=graft(executessh_5.Stdout))  # -> Output, Pairs
panel_90 = Panel("psign -h 15 <h> | pcompos <target> 0 0 - 570 20 > <target-.>_s.hdr;echo <target-.>_s.hdr")
executessh_wip_18 = ExecuteSSHWIP(
    _SSHCommands_=overrides_38.Output,
    Run=executessh_5.Ran,
    addPrefix=True,
    description="pcond -h <hdr> <hdr>_exposed.hdr;echo <hdr>_exposed.hdr",
    fireLogs=False,
    lastRunTime=1862,
    suppressWarnings=False)  # -> Stdout, Stderr_, Ran
hours_9 = Number(hours)
overrides_39 = ApplyOverrides(Input_=panel_90, H=graft(hours_9), Target=graft(executessh_wip_18.Stdout))  # -> Output, Pairs
panel_91 = Panel("""pcond -h <hdr> <hdr-.>_exposed.hdr
ra_tiff <hdr-.>_exposed.hdr <hdr-.>_exposed.tif
convert <hdr-.>_exposed.tif <hdr-.>_exposed.png
echo <hdr-.>_exposed.png""")
panel_92 = Panel(overrides_39.Output)
panel_93 = Panel("""pcompos -a 3 -s 10 -b 0.2 0.2 0.2 <hdrFiles> > <proj>/images/<target>
ra_tiff <proj>/images/<target> <proj>/images/<target-.>.tif
convert <proj>/images/<target-.>.tif <proj>/images/<target-.>.png
echo <proj>/images/<target-.>.png""")

lng = ListLength(List=flatten(executessh_wip_18.Stdout))
python_16 = GhPythonScript(cnt=lng, run=executessh_wip_18.Ran)  # -> out, ran; inputs cnt: Int32, run: Boolean
# ---------- python_16: Python ----------
__author__ = "mm1013"
__version__ = "2022.08.30"

import rhinoscriptsyntax as rs

ran = cnt > 1 and run
# ---------- end python_16 ----------

executessh_wip_19 = ExecuteSSHWIP(
    _SSHCommands_=overrides_39.Output,
    Run=python_16.ran,
    addPrefix=True,
    description="""psign -h 15 800 | pcompos <target> 0 0 - 570 20 > <target>_s.hdr;echo <target>_s.hdr


- - -

psign -h 15 900 | pcompos <target> 0 0 - 570 20 > <target>_s.hdr;echo <target>_s.hdr


- - -

psign -h 15 1000 | pcompos <target> 0 0 - 570 20 > <target>_s.hdr;echo <target>_s.hdr


- - -

psign -h 15 1100 | pcompos <target> 0 0 - 570 20 > <target>_s.hdr;echo <target>_s.hdr


- - -

psign -h 15 1200 | pcompos <target> 0 0 - 570 20 > <target>_s.hdr;echo <target>_s.hdr


- - -

psign -h 15 1300 | pcompos <target> 0 0 - 570 20 > <target>_s.hdr;echo <target>_s.hdr


- - -

psign -h 15 1400 | pcompos <target> 0 0 - 570 20 > <target>_s.hdr;echo <target>_s.hdr


- - -

psign -h 15 1500 | pcompos <target> 0 0 - 570 20 > <target>_s.hdr;echo <target>_s.hdr


- - -

psign -h 15 1600 | pcompos <target> 0 0 - 570 20 > <target>_s.hdr;echo <target>_s.hdr


- - -

psign -h 15 1700 | pcompos <target> 0 0 - 570 20 > <target>_s.hdr;echo <target>_s.hdr""",
    fireLogs=False,
    lastRunTime=4066,
    suppressWarnings=False)  # -> Stdout, Stderr_, Ran
overrides_40 = ApplyOverrides(Input_=panel_91, Hdr=graft(executessh_wip_19.Stdout))  # -> Output, Pairs
join_6 = TextJoin(Text=flatten(executessh_wip_19.Stdout), Join=" ")
overrides_41 = ApplyOverrides(Input_=panel_93, HdrFiles=graft(join_6), Target=graft("combined.hdr"))  # -> Output, Pairs
executessh_wip_20 = ExecuteSSHWIP(
    _SSHCommands_=overrides_41.Output,
    Run=invert(executessh_wip_19.Ran),
    addPrefix=True,
    description="""pcompos -a 3 -s 10 -b 0.2 0.2 0.2 <hdrFiles> > ~/simulation/boston/images/combined.hdr
ra_tiff ~/simulation/boston/images/combined.hdr ~/simulation/boston/images/combined.tif
convert ~/simulation/boston/images/combined.tif ~/simulation/boston/images/combined.png
echo ~/simulation/boston/images/combined.png""",
    fireLogs=False,
    lastRunTime=13.8113,
    suppressWarnings=False,
    stderr="""bash: -c: line 0: syntax error near unexpected token `>'
bash: -c: line 0: `export PATH=$PATH:/usr/local/radiance/bin;export RAYPATH=.:/usr/local/radiance/lib;export DISPLAY=$(ip route list default | awk '{print $3}'):0;export LIBGL_ALWAYS_INDIRECT=1;pcompos -a 3 -s 10 -b 0.2 0.2 0.2 <hdrFiles> > ~/simulation/boston/images/combined.hdr'""",
    commands="""pcompos -a 3 -s 10 -b 0.2 0.2 0.2 <hdrFiles> > ~/simulation/boston/images/combined.hdr
ra_tiff ~/simulation/boston/images/combined.hdr ~/simulation/boston/images/combined.tif
convert ~/simulation/boston/images/combined.tif ~/simulation/boston/images/combined.png
echo ~/simulation/boston/images/combined.png""")  # -> Stdout, Stderr_, Ran

# ----
# -la for titel: pcompos -la -a 3 -s 10 -b 1 1 1 <hdrFiles> > <proj>/images/<target>
# echo <proj>/images/<target>
# PNGS
executessh_wip_21 = ExecuteSSHWIP(
    _SSHCommands_=overrides_40.Output,
    Run=executessh_wip_18.Ran,
    addPrefix=True,
    description="""pcond -h <hdr> <hdr>_exposed.hdr
ra_tiff <hdr>_exposed.hdr <hdr>_exposed.tif
convert <hdr>_exposed.tif <hdr>_exposed.png
echo <hdr>_exposed.png


- - -

pcond -h <hdr> <hdr>_exposed.hdr
ra_tiff <hdr>_exposed.hdr <hdr>_exposed.tif
convert <hdr>_exposed.tif <hdr>_exposed.png
echo <hdr>_exposed.png


- - -

pcond -h <hdr> <hdr>_exposed.hdr
ra_tiff <hdr>_exposed.hdr <hdr>_exposed.tif
convert <hdr>_exposed.tif <hdr>_exposed.png
echo <hdr>_exposed.png


- - -

pcond -h <hdr> <hdr>_exposed.hdr
ra_tiff <hdr>_exposed.hdr <hdr>_exposed.tif
convert <hdr>_exposed.tif <hdr>_exposed.png
echo <hdr>_exposed.png


- - -

pcond -h <hdr> <hdr>_exposed.hdr
ra_tiff <hdr>_exposed.hdr <hdr>_exposed.tif
convert <hdr>_exposed.tif <hdr>_exposed.png
echo <hdr>_exposed.png


- - -

pcond -h <hdr> <hdr>_exposed.hdr
ra_tiff <hdr>_exposed.hdr <hdr>_exposed.tif
convert <hdr>_exposed.tif <hdr>_exposed.png
echo <hdr>_exposed.png


- - -

pcond -h <hdr> <hdr>_exposed.hdr
ra_tiff <hdr>_exposed.hdr <hdr>_exposed.tif
convert <hdr>_exposed.tif <hdr>_exposed.png
echo <hdr>_exposed.png


- - -

pcond -h <hdr> <hdr>_exposed.hdr
ra_tiff <hdr>_exposed.hdr <hdr>_exposed.tif
convert <hdr>_exposed.tif <hdr>_exposed.png
echo <hdr>_exposed.png


- - -

pcond -h <hdr> <hdr>_exposed.hdr
ra_tiff <hdr>_exposed.hdr <hdr>_exposed.tif
convert <hdr>_exposed.tif <hdr>_exposed.png
echo <hdr>_exposed.png


- - -

pcond -h <hdr> <hdr>_exposed.hdr
ra_tiff <hdr>_exposed.hdr <hdr>_exposed.tif
convert <hdr>_exposed.tif <hdr>_exposed.png
echo <hdr>_exposed.png""",
    fireLogs=False,
    lastRunTime=1962,
    suppressWarnings=False)  # -> Stdout, Stderr_, Ran
convertpaths_16 = ConvertPaths(I=executessh_wip_21.Stdout)  # -> Linux, flatten(Windows)
imageviewer_13 = LBImageViewer(ImagePath_=convertpaths_16.Windows, _scale_="2", DisableClickable=False, SaveImgWithCoords=False, scale=2)  # -> ImagePath, Values, GIF

convertpaths_17 = ConvertPaths(I=executessh_wip_20.Stdout)  # -> Linux, flatten(Windows)
imageviewer_14 = LBImageViewer(ImagePath_=convertpaths_17.Windows, _scale_="2", DisableClickable=False, SaveImgWithCoords=False, scale=2)  # -> ImagePath, Values, GIF

# ==== cluster DefaultMSS
default_value_flattened = ClusterInput()
data = ClusterInput()
data_2 = Data(data)
merge = Merge(Data1=flatten(data_2), Data2="0")  # -> flatten(Result)
default_value_flattened_2 = Data(flatten(default_value_flattened))
lng = ListLength(List=merge)
equals = Equality(FirstNumber=lng, SecondNumber="1")  # -> Equality, Inequality
cull = CullPattern(List=data_2, CullPattern=invert(equals.Equality))
panel = Panel(equals.Equality)
cull_2 = CullPattern(List=default_value_flattened_2, CullPattern=equals.Equality)
data_3 = Data([cull, cull_2])
data_4 = ClusterOutput(data_3)

# ==== cluster MeshIt2: Meshes everything in the input. Graft the input if you want to make several meshes, otherwise returns a joined mesh.
mesh_brep = ClusterInput()
mesh_brep_2 = Geometry(simplify(mesh_brep))
tmatch = MatchText(Text=mesh_brep_2, RegEx="(mesh)", Case=False)
tmatch_2 = MatchText(Text=mesh_brep_2, RegEx="(brep)|(polysurface)|(surface)|(extrusion)", Case=False)
group = Group(Objects=mesh_brep_2)
cull = CullPattern(List=mesh_brep_2, CullPattern=tmatch_2)
mesh = MeshBrep(
    Brep=cull,
    Settings={GridMaxCount=0, GridMinCount=16, JaggedSeams=False, MaxEdgeLength=0, MinEdgeLength=0.0001, MinTolerance=0, Refine=True, RefineAngle=0, RelativeTolerance=0.65, SimplePlanes=True, Tolerance=0})  # -> simplify(Mesh)
cull_2 = CullPattern(List=mesh_brep_2, CullPattern=tmatch)  # -> simplify(List)

# ----
# Fix invalid mesh
panel = Panel("Invalid Mesh")  # disabled
mesh_2 = Mesh(mesh)  # disabled
tmatch_3 = MatchText(Text=mesh_2, RegEx=panel, Case=False)  # disabled
unweave = Unweave(List=mesh_2, UnweavePattern=tmatch_3)  # -> Data0, Data1; disabled
explode = MeshExplode(Mesh=unweave.Data1, Interpolate=False)  # -> simplify(Faces); disabled
abc_a = ABC(data=explode)  # disabled
panel_2 = Panel("0")  # disabled
num = Number(panel_2)  # disabled
area = MeshArea(Mesh=abc_a)  # -> Area, Centroid; disabled
equals = Equality(FirstNumber=area.Area, SecondNumber=num)  # -> Equality, Inequality; disabled
cull_3 = CullPattern(List=abc_a, CullPattern=equals.Inequality)  # disabled
mjoin = MeshJoin(Meshes=[cull_3, unweave.Data0])  # disabled

# ----
# Fix invalid mesh
panel_3 = Panel("Invalid Mesh")  # disabled
mesh_3 = Mesh(cull_2)  # disabled
tmatch_4 = MatchText(Text=mesh_3, RegEx=panel_3, Case=False)  # disabled
unweave_2 = Unweave(List=mesh_3, UnweavePattern=tmatch_4)  # -> Data0, Data1; disabled
explode_2 = MeshExplode(Mesh=unweave_2.Data1, Interpolate=False)  # -> simplify(Faces); disabled
abc_a_2 = ABC(data=explode_2)  # disabled
panel_4 = Panel("0")  # disabled
num_2 = Number(panel_4)  # disabled
area_2 = MeshArea(Mesh=abc_a_2)  # -> Area, Centroid; disabled
equals_2 = Equality(FirstNumber=area_2.Area, SecondNumber=num_2)  # -> Equality, Inequality; disabled
cull_4 = CullPattern(List=abc_a_2, CullPattern=equals_2.Inequality)  # disabled
mjoin_2 = MeshJoin(Meshes=[cull_4, unweave_2.Data0])  # disabled

mjoin_3 = MeshJoin(Meshes=[mesh, cull_2])
c_script = CSharpScript(mesh=mjoin_3)  # -> A; inputs mesh: Mesh
# ---------- c_script: C# ----------
    mesh.Faces.CullDegenerateFaces();
    A = mesh;
# ---------- end c_script ----------
abc_a_3 = ABC(data=mjoin)  # disabled
abc_a_4 = ABC(data=mjoin_2)  # disabled
clean = CleanTree(RemoveNulls=True, RemoveInvalid=True, RemoveEmpty=False, Tree=[abc_a_3, abc_a_4])  # disabled
mjoin_4 = MeshJoin(Meshes=clean)  # disabled
unflatten = UnflattenTree(Tree=c_script, Guide=group)
mesh_explode = MeshExplode(m=mjoin_4)  # -> out, simplify(A); disabled
# ---------- mesh_explode: VB ----------
    Component.Params.Input(0).Name = "Mesh"
    Component.Params.Input(0).Description = "Open or closed mesh"

    Component.Params.Output(1).Name = "Mesh"
    Component.Params.Output(1).Description = "If successful, a valid mesh"

    If m IsNot Nothing Then
      Dim pts As Rhino.Geometry.Collections.MeshVertexList
      Dim faces As Rhino.Geometry.Collections.MeshFaceList
      Dim clrs As Rhino.Geometry.Collections.MeshVertexColorList
      Dim i As Integer
      Dim mshs As New list(Of mesh)

      faces = m.Faces
      pts = m.Vertices
      If m.VertexColors.count() = 0 Then m.VertexColors.CreateMonotoneMesh(color.FromArgb(100, 100, 100))
      clrs = m.VertexColors

      For i = 0 To faces.count() - 1 Step 1
        Dim fc As New meshFace
        Dim face As New MeshFace
        Dim ptList As New list(Of point3d)
        Dim clrList As New list(Of color)
        Dim msh As New mesh

        face = faces(i)

        ptList.add(New point3d(pts(face.A)))
        ptList.add(New point3d(pts(face.B)))
        ptList.add(New point3d(pts(face.C)))
        If face.IsQuad Then ptList.add(New point3d(pts(face.D)))

        clrList.add(clrs(face.A))
        clrList.add(clrs(face.B))
        clrList.add(clrs(face.C))
        If face.IsQuad Then clrList.add(clrs(face.D))

        If face.IsQuad Then fc = New meshFace(0, 1, 2, 3) Else fc = New meshface(0, 1, 2)

        msh.Vertices.AddVertices(ptList.toarray())
        msh.Faces.AddFace(fc)
        msh.VertexColors.SetColors(clrList.toarray())
        mshs.add(msh)
      Next

      A = mshs
    End If
# ---------- end mesh_explode ----------
c_script_2 = CSharpScript(mesh=mjoin_4)  # -> A; inputs mesh: Mesh; disabled; same code as c_script
c_script_3 = CSharpScript(mesh=mesh_explode.A)  # -> out, A; inputs mesh: list of Mesh; disabled
# ---------- c_script_3: C# ----------
    List<bool> isValid = new List<bool>();
    for (int i = 0; i < mesh.Count; i++)
    {
      isValid.Add(mesh[i].IsValid);
    }
    
    A = isValid;
# ---------- end c_script_3 ----------
mesh_joined = Mesh(unflatten)
cullf = CullFaces(Mesh=mjoin_4, Pattern=invert(c_script_3.A))  # disabled
mesh_joined_2 = ClusterOutput(mesh_joined)

# ==== cluster LargestBREP
window_breps = ClusterInput()
window_breps_2 = Brep(window_breps)
debrep = DeconstructBrep(Brep=window_breps_2)  # -> Faces, Edges, Vertices
area = Area(Geometry=debrep.Faces)  # -> Area, Centroid
sort = SortList(Keys=area.Area, ValuesA=debrep.Faces)  # -> Keys, ValuesA
item = ListItem(List=sort.ValuesA, Index=-1, Wrap=True)
group = Group(Objects=flatten(item))
grouped = ClusterOutput(group)

# ==== cluster ABC
data = ClusterInput()
data_2 = Data(data)
path_mapper = PathMapper(
    data_2,
    source=["{A;B;C;D;E;F;G}", "{A;B;C;D;E;F}", "{A;B;C;D;E}", "{A;B;C;D}", "{A;B;C}", "{A;B}", "{A}"],
    target=["{A}", "{A}", "{A}", "{A}", "{A}", "{A}", "{A}"])
data_3 = Data(path_mapper)
data_4 = ClusterOutput(data_3)
